# Grasshopper definition Radial_Slit.gh (Grasshopper 1.0.8)

# ---- group: Detailed parameter adjustment
channel_width = Slider(4, range=0..100)
inter_slit_angle = Slider(8, range=0..100)
number_of_equal_divisions = Slider(9, range=0..100)

# ---- group: Global adjustment
minimum_circle_radius = Slider(8, range=0..100)
number_of_ring_arrays = Slider(6, range=0..100)

# ---- group: ignore
切缝宽度 = Slider(0.28, range=0..1)

气道口长度 = Slider(50, range=0..100)
气道口宽度 = Slider(7, range=0..100)

# ----
cir = Circle(Plane=PlaneXY(0, 0, 0), Radius=minimum_circle_radius)
series = Series(Start=channel_width, Step=channel_width, Count=expr("x-1", number_of_ring_arrays))
总间隙角度 = Multiplication(A=number_of_equal_divisions, B=inter_slit_angle)
division = Division(A=切缝宽度, B="2")
rectangle = Rectangle(Plane=PlaneXY(0, 0, 0), XSize=气道口长度, YSize=气道口宽度, Radius=0)  # -> Rectangle, Length
multiplication = Multiplication(A=channel_width, B=number_of_ring_arrays)
offset = OffsetCurve(Curve=cir, Distance=series, Corners=1)  # -> flatten(Curve)
series_2 = Series(Start="0", Step="1", Count=expr("x-1", number_of_ring_arrays))
subtraction = Subtraction(A="360", B=总间隙角度)
addition = Addition(A=multiplication, B=minimum_circle_radius)
division_2 = Division(A=channel_width, B="5")
mod = Modulus(A=series_2, B="2")
offset_2 = OffsetCurve(Curve=cir, Distance=multiplication, Corners=1)
弧线旋转角度 = Division(A=subtraction, B=number_of_equal_divisions)
equals = Equality(FirstNumber=mod, SecondNumber="0")  # -> Equality, Inequality
subtraction_2 = Subtraction(A=addition, B=division_2)
X = UnitX(Factor=subtraction_2)
dispatch = Dispatch(List=offset, DispatchPattern=equals.Equality)  # -> ListA, ListB
move = Move(Geometry=rectangle.Rectangle, Motion=X)  # -> Geometry, Transform
srf = Surface(offset_2)
division_3 = Division(A=气道口宽度, B="2")
division_4 = Division(A=弧线旋转角度, B="2")
neg = Negative(Value=division_3)
奇数圆 = Curve(dispatch.ListA)
偶数圆 = Curve(dispatch.ListB)
Y = UnitY(Factor=neg)
move_2 = Move(Geometry=move.Geometry, Motion=Y)  # -> Geometry, Transform
srf_2 = Surface(move_2.Geometry)
division_5 = Division(A=inter_slit_angle, B="2")
divide = DivideCurve(Curve=奇数圆, Count=number_of_equal_divisions, Kinks=False)  # -> Points, Tangents, Parameters
sunion = SolidUnion(Breps=flatten([srf, srf_2]))
divide_2 = DivideCurve(Curve=偶数圆, Count=number_of_equal_divisions, Kinks=False)  # -> Points, Tangents, Parameters
addition_2 = Addition(A=division_4, B=division_5)
rotate = Rotate(Geometry=divide.Points, Angle=degrees(division_4), Plane=PlaneXY(0, 0, 0))  # -> Geometry, Transform
rotate_2 = Rotate(Geometry=divide.Points, Angle=degrees(弧线旋转角度), Plane=PlaneXY(0, 0, 0))  # -> Geometry, Transform
edges = BrepEdges(Brep=sunion)  # -> Naked, Interior, NonManifold
rotate_3 = Rotate(Geometry=divide_2.Points, Angle=degrees(addition_2), Plane=PlaneXY(0, 0, 0))  # -> Geometry, Transform
rotate_4 = Rotate(Geometry=rotate_3.Geometry, Angle=degrees(division_4), Plane=PlaneXY(0, 0, 0))  # -> Geometry, Transform
rotate_5 = Rotate(Geometry=rotate_3.Geometry, Angle=degrees(弧线旋转角度), Plane=PlaneXY(0, 0, 0))  # -> Geometry, Transform
crv = Curve(edges.Naked)
arc = Arc3Pt(PointA=divide.Points, PointB=rotate.Geometry, PointC=rotate_2.Geometry)  # -> Arc, Plane, Radius
arc_2 = Arc3Pt(PointA=rotate_3.Geometry, PointB=rotate_4.Geometry, PointC=rotate_5.Geometry)  # -> Arc, Plane, Radius
neg_2 = Negative(Value=division)
offset_3 = OffsetCurve(Curve=arc.Arc, Distance=division, Corners=1)
offset_4 = OffsetCurve(Curve=arc.Arc, Distance=neg_2, Corners=1)
offset_5 = OffsetCurve(Curve=arc_2.Arc, Distance=division, Corners=1)
offset_6 = OffsetCurve(Curve=arc_2.Arc, Distance=neg_2, Corners=1)
end = EndPoints(Curve=offset_3)  # -> Start, End
end_2 = EndPoints(Curve=offset_4)  # -> Start, End
end_3 = EndPoints(Curve=offset_5)  # -> Start, End
end_4 = EndPoints(Curve=offset_6)  # -> Start, End
ln = Line(StartPoint=end.Start, EndPoint=end_2.Start)
ln_2 = Line(StartPoint=end_3.Start, EndPoint=end_4.Start)
ln_3 = Line(StartPoint=end.End, EndPoint=end_2.End)
ln_4 = Line(StartPoint=end_3.End, EndPoint=end_4.End)
merge = Merge(Data1=arc.Arc, Data2=arc_2.Arc, Data3=crv, Data4=cir)
