# Grasshopper definition Y-Shaped_Slit.gh (Grasshopper 1.0.8)

# ---- group: Detailed parameter adjustment
outer_maximum_slit_length = Slider(6.6, range=0..100)
central_minimum_slit_length = Slider(3.2, range=0..100)
slit_center_distance = Slider(11, range=0..100)

# ---- group: Global adjustment
number_of_ring_arrays = Slider(2, range=0..100)

# ---- group: ignore
切缝宽度 = Slider(0.3, range=0..1)

气道口长度 = Slider(52, range=0..100)
气道口宽度 = Slider(7, range=0..100)

# ----
cir = Circle(Plane=PlaneXY(0, 0, 0), Radius=slit_center_distance)
sqrt = SquareRoot(Value="3")
multiplication = Multiplication(A=slit_center_distance, B="2")
subtraction = Subtraction(A=number_of_ring_arrays, B="1")
rectangle = Rectangle(Plane=PlaneXY(0, 0, 0), XSize=气道口长度, YSize=气道口宽度, Radius=0)  # -> Rectangle, Length
series = Series(Start=slit_center_distance, Step=slit_center_distance, Count=expr("x-1", number_of_ring_arrays))
subtraction_2 = Subtraction(A=outer_maximum_slit_length, B=central_minimum_slit_length)
divide = DivideCurve(Curve=cir, Count="6", Kinks=False)  # -> Points, Tangents, Parameters
division = Division(A=multiplication, B=sqrt)
division_2 = Division(A=切缝宽度, B="2")
multiplication_2 = Multiplication(A=subtraction, B=division)
pline = PolyLine(Vertices=divide.Points, Closed="1")
panel = Panel(series)
division_3 = Division(A=subtraction_2, B=number_of_ring_arrays)
pt = Point(Point(0, 0, 0))
offset = OffsetCurve(Curve=pline, Distance=series, Corners=1)
X = UnitX(Factor=1)
addition = Addition(A=multiplication_2, B=outer_maximum_slit_length)
X_2 = UnitX(Factor=1)
series_2 = Series(Start="12", Step="6", Count=expr("x-1", number_of_ring_arrays))  # -> graft(Series)
series_3 = Series(Start=central_minimum_slit_length, Step=division_3, Count=expr("x+1", number_of_ring_arrays))
neg = Negative(Value=X)
divide_2 = DivideCurve(Curve=cir, Count="6", Kinks=False)  # -> Points, Tangents, Parameters
division_4 = Division(A=气道口宽度, B="2")
neg_2 = Negative(Value=X_2)
addition_2 = Addition(A=addition, B="2")
addition_3 = Addition(A=central_minimum_slit_length, B=division_3)
multiplication_3 = Multiplication(A=number_of_ring_arrays, B=slit_center_distance)
panel_2 = Panel(series_2)
divide_3 = DivideCurve(Curve=offset, Count=series_2, Kinks=False)  # -> Points, Tangents, Parameters
pt_2 = Point(<point referenced from the Rhino model>)
line = LineSDL(Start=pt, Direction=neg, Length=central_minimum_slit_length)
offset_2 = OffsetCurve(Curve=cir, Distance=addition_2, Corners=1)
X_3 = UnitX(Factor=1)
line_2 = LineSDL(Start=pt_2, Direction=neg_2, Length=central_minimum_slit_length)
X_4 = UnitX(Factor=1)
addition_4 = Addition(A=multiplication_3, B="2")
cull_i = CullIndex(List=series_3, Indices="0", Wrap=True)
neg_3 = Negative(Value=division_4)
dup = DuplicateData(Data=line, Number="1", Order=True)
dup_2 = DuplicateData(Data=line, Number="1", Order=True)
neg_4 = Negative(Value=X_4)
neg_5 = Negative(Value=X_3)
addition_5 = Addition(A=addition_4, B=outer_maximum_slit_length)
dup_3 = DuplicateData(Data=line_2, Number="1", Order=True)
dup_4 = DuplicateData(Data=line_2, Number="1", Order=True)
rotate = Rotate(Geometry=dup, Angle=degrees("120"), Plane=PlaneXY(0, 0, 0))  # -> Geometry, Transform
rotate_2 = Rotate(Geometry=dup_2, Angle=degrees("-120"), Plane=PlaneXY(0, 0, 0))  # -> Geometry, Transform
cull_i_2 = CullIndex(List=cull_i, Indices="0", Wrap=True)
line_3 = LineSDL(Start=divide_3.Points, Direction=neg_5, Length=graft(cull_i_2))
subtraction_3 = Subtraction(A=addition_5, B="0.5")
line_4 = LineSDL(Start=divide_2.Points, Direction=neg_4, Length=addition_3)
crv = Curve(rotate.Geometry)
crv_2 = Curve(rotate_2.Geometry)
Y = UnitY(Factor=neg_3)
X_5 = UnitX(Factor=subtraction_3)
move = Move(Geometry=rectangle.Rectangle, Motion=X_5)  # -> Geometry, Transform
rotate_3 = Rotate(Geometry=dup_3, Angle=degrees("120"), Plane=PlaneXY(0, 0, 0))  # -> Geometry, Transform
rotate_4 = Rotate(Geometry=dup_4, Angle=degrees("-120"), Plane=PlaneXY(0, 0, 0))  # -> Geometry, Transform
srf = Surface(offset_2)
merge = Merge(Data1=crv, Data2=crv_2, Data3=line)
dup_5 = DuplicateData(Data=line_3, Number="1", Order=True)
dup_6 = DuplicateData(Data=line_3, Number="1", Order=True)
dup_7 = DuplicateData(Data=line_4, Number="1", Order=True)
dup_8 = DuplicateData(Data=line_4, Number="1", Order=True)
move_2 = Move(Geometry=move.Geometry, Motion=Y)  # -> Geometry, Transform
srf_2 = Surface(move_2.Geometry)
rotate_5 = Rotate(Geometry=dup_5, Angle=degrees("120"), Plane=PlaneXY(0, 0, 0))  # -> Geometry, Transform
rotate_6 = Rotate(Geometry=dup_6, Angle=degrees("-120"), Plane=PlaneXY(0, 0, 0))  # -> Geometry, Transform
rotate_7 = Rotate(Geometry=dup_7, Angle=degrees("120"), Plane=PlaneXY(0, 0, 0))  # -> Geometry, Transform
rotate_8 = Rotate(Geometry=dup_8, Angle=degrees("-120"), Plane=PlaneXY(0, 0, 0))  # -> Geometry, Transform
neg_6 = Negative(Value=division_2)
sunion = SolidUnion(Breps=flatten([srf_2, srf]))
edges = BrepEdges(Brep=sunion)  # -> Naked, Interior, NonManifold
offset_3 = OffsetCurve(Curve=line_2, Distance=division_2, Corners=1)
offset_4 = OffsetCurve(Curve=rotate_3.Geometry, Distance=division_2, Corners=1)
offset_5 = OffsetCurve(Curve=rotate_4.Geometry, Distance=division_2, Corners=1)
crv_3 = Curve(edges.Naked)
offset_6 = OffsetCurve(Curve=line_2, Distance=neg_6, Corners=1)
offset_7 = OffsetCurve(Curve=rotate_3.Geometry, Distance=neg_6, Corners=1)
offset_8 = OffsetCurve(Curve=rotate_4.Geometry, Distance=neg_6, Corners=1)
offset_9 = OffsetCurve(Curve=rotate_5.Geometry, Distance=division_2, Corners=1)
offset_10 = OffsetCurve(Curve=rotate_6.Geometry, Distance=division_2, Corners=1)
offset_11 = OffsetCurve(Curve=line_3, Distance=division_2, Corners=1)
merge_2 = Merge(
    Data1=merge,
    Data2=rotate_8.Geometry,
    Data3=rotate_7.Geometry,
    Data4=rotate_6.Geometry,
    Data5=rotate_5.Geometry,
    Data6=line_4,
    Data7=line_3)
end = EndPoints(Curve=offset_6)  # -> Start, End
end_2 = EndPoints(Curve=offset_3)  # -> Start, End
end_3 = EndPoints(Curve=offset_4)  # -> Start, End
end_4 = EndPoints(Curve=offset_7)  # -> Start, End
end_5 = EndPoints(Curve=offset_8)  # -> Start, End
end_6 = EndPoints(Curve=offset_5)  # -> Start, End
offset_12 = OffsetCurve(Curve=rotate_7.Geometry, Distance=division_2, Corners=1)
offset_13 = OffsetCurve(Curve=rotate_8.Geometry, Distance=division_2, Corners=1)
offset_14 = OffsetCurve(Curve=line_4, Distance=division_2, Corners=1)
rotate_9 = Rotate(Geometry=merge_2, Angle=1.570796327, Plane=PlaneXY(0, 0, 0))  # -> Geometry, Transform
offset_15 = OffsetCurve(Curve=rotate_5.Geometry, Distance=neg_6, Corners=1)
offset_16 = OffsetCurve(Curve=rotate_6.Geometry, Distance=neg_6, Corners=1)
offset_17 = OffsetCurve(Curve=line_3, Distance=neg_6, Corners=1)
ln = Line(StartPoint=end.End, EndPoint=end_2.End)
ln_2 = Line(StartPoint=end_3.End, EndPoint=end_4.End)
ln_3 = Line(StartPoint=end_5.End, EndPoint=end_6.End)
crv_4 = Curve(rotate_9.Geometry)
merge_3 = Merge(Data1=crv_3, Data2=crv_4)
offset_18 = OffsetCurve(Curve=rotate_7.Geometry, Distance=neg_6, Corners=1)
offset_19 = OffsetCurve(Curve=rotate_8.Geometry, Distance=neg_6, Corners=1)
offset_20 = OffsetCurve(Curve=line_4, Distance=neg_6, Corners=1)
ln_4 = Line(StartPoint=end.Start, EndPoint=end_2.Start)
ln_5 = Line(StartPoint=end_3.Start, EndPoint=end_4.Start)
ln_6 = Line(StartPoint=end_5.Start, EndPoint=end_6.Start)
end_7 = EndPoints(Curve=offset_9)  # -> Start, End
end_8 = EndPoints(Curve=offset_15)  # -> Start, End
end_9 = EndPoints(Curve=offset_10)  # -> Start, End
end_10 = EndPoints(Curve=offset_16)  # -> Start, End
end_11 = EndPoints(Curve=offset_11)  # -> Start, End
end_12 = EndPoints(Curve=offset_17)  # -> Start, End
boundary = BoundarySurfaces(Edges=[ln_4, ln, offset_6, offset_3])
boundary_2 = BoundarySurfaces(Edges=[ln_5, ln_2, offset_7, offset_4])
boundary_3 = BoundarySurfaces(Edges=[ln_6, ln_3, offset_8, offset_5])
ln_7 = Line(StartPoint=end_7.End, EndPoint=end_8.End)
ln_8 = Line(StartPoint=end_9.End, EndPoint=end_10.End)
ln_9 = Line(StartPoint=end_11.End, EndPoint=end_12.End)
end_13 = EndPoints(Curve=offset_12)  # -> Start, End
end_14 = EndPoints(Curve=offset_18)  # -> Start, End
end_15 = EndPoints(Curve=offset_19)  # -> Start, End
end_16 = EndPoints(Curve=offset_13)  # -> Start, End
end_17 = EndPoints(Curve=offset_20)  # -> Start, End
end_18 = EndPoints(Curve=offset_14)  # -> Start, End
ln_10 = Line(StartPoint=end_11.Start, EndPoint=end_12.Start)
ln_11 = Line(StartPoint=end_13.End, EndPoint=end_14.End)
ln_12 = Line(StartPoint=end_15.End, EndPoint=end_16.End)
ln_13 = Line(StartPoint=end_17.End, EndPoint=end_18.End)
ln_14 = Line(StartPoint=end_7.Start, EndPoint=end_8.Start)
ln_15 = Line(StartPoint=end_9.Start, EndPoint=end_10.Start)
sunion_2 = SolidUnion(Breps=flatten([boundary, boundary_2, boundary_3]))
ln_16 = Line(StartPoint=end_17.Start, EndPoint=end_18.Start)
boundary_4 = BoundarySurfaces(Edges=[ln_14, ln_7, offset_15, offset_9])
boundary_5 = BoundarySurfaces(Edges=[ln_15, ln_8, offset_16, offset_10])
boundary_6 = BoundarySurfaces(Edges=[ln_10, ln_9, offset_17, offset_11])
ln_17 = Line(StartPoint=end_13.Start, EndPoint=end_14.Start)
ln_18 = Line(StartPoint=end_15.Start, EndPoint=end_16.Start)
edges_2 = BrepEdges(Brep=sunion_2)  # -> Naked, Interior, NonManifold
boundary_7 = BoundarySurfaces(Edges=[ln_17, ln_11, offset_18, offset_12])
boundary_8 = BoundarySurfaces(Edges=[ln_18, ln_12, offset_19, offset_13])
boundary_9 = BoundarySurfaces(Edges=[ln_16, ln_13, offset_20, offset_14])
sunion_3 = SolidUnion(Breps=flatten([boundary_5, boundary_4, boundary_6]))
crv_5 = Curve(edges_2.Naked)
edges_3 = BrepEdges(Brep=sunion_3)  # -> Naked, Interior, NonManifold
sunion_4 = SolidUnion(Breps=flatten([boundary_7, boundary_8, boundary_9]))
crv_6 = Curve(edges_3.Naked)
edges_4 = BrepEdges(Brep=sunion_4)  # -> Naked, Interior, NonManifold
crv_7 = Curve(edges_4.Naked)
