# Grasshopper definition Array_Disconnected.gh (Grasshopper 1.0.8)

# ---- group: ignore
气口长度 = Slider(47, range=0..100)
气口宽度 = Slider(10, range=0..100)

# ---- group: Global adjustment
vertical_units_number = Slider(4, range=0..100)
horizontal_arrays_number = Slider(3, range=0..100)

# ---- group: Detailed parameter adjustment
single_column_width = Slider(60, range=0..100)
side_slit_length = Slider(10, range=0..100)
channel_width = Slider(8, range=0..100)
spacing_between_columns = Slider(20, range=0..100)

# ----
subtraction = Subtraction(A=single_column_width, B=spacing_between_columns)
neg = Negative(Value=channel_width)
pt = Point(Point(0, 0, 0))
division = Division(A=side_slit_length, B="2")
division_2 = Division(A=subtraction, B="2")
Y = UnitY(Factor=气口长度)
X = UnitX(Factor=气口宽度)
multiplication = Multiplication(A=horizontal_arrays_number, B=subtraction)
subtraction_2 = Subtraction(A=horizontal_arrays_number, B="1")
addition = Addition(A=subtraction, B=spacing_between_columns)
Y_2 = UnitY(Factor=neg)
crv = Curve(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)
crv_2 = Curve(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)
crv_3 = Curve(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)
multiplication_2 = Multiplication(A=channel_width, B="2")
subtraction_3 = Subtraction(A=division_2, B=division)
Y_3 = UnitY(Factor=气口长度)

move = Move(Geometry=pt, Motion=Y)  # -> Geometry, Transform
move_2 = Move(Geometry=pt, Motion=X)  # -> Geometry, Transform
move_3 = Move(Geometry=move_2.Geometry, Motion=Y_3)  # -> Geometry, Transform

multiplication_3 = Multiplication(A=spacing_between_columns, B=subtraction_2)
series = Series(Start=addition, Step=addition, Count=expr("x-1", horizontal_arrays_number))
series_2 = Series(Start=multiplication_2, Step=multiplication_2, Count=expr("x-1", vertical_units_number))
addition_2 = Addition(A=multiplication_3, B=multiplication)
ln = Line(StartPoint=move.Geometry, EndPoint=pt)
series_3 = Series(Start=multiplication_2, Step=multiplication_2, Count=expr("x-2", vertical_units_number))
neg_2 = Negative(Value=subtraction_3)
X_2 = UnitX(Factor=subtraction)
series_4 = Series(Start=multiplication_2, Step=multiplication_2, Count=expr("x-1", vertical_units_number))
multiplication_4 = Multiplication(A=multiplication_2, B=vertical_units_number)
ln_2 = Line(StartPoint=move_2.Geometry, EndPoint=move_3.Geometry)
X_3 = UnitX(Factor=neg_2)
neg_3 = Negative(Value=series_2)
panel = Panel(multiplication_4)
neg_4 = Negative(Value=series_3)
X_4 = UnitX(Factor=series)
X_5 = UnitX(Factor=addition_2)
neg_5 = Negative(Value=series_4)
move_4 = Move(Geometry=pt, Motion=X_3)  # -> Geometry, Transform

move_5 = Move(Geometry=move_4.Geometry, Motion=Y_2)  # -> Geometry, Transform
move_6 = Move(Geometry=move_5.Geometry, Motion=X_2)  # -> Geometry, Transform

vec2pt = Vector2Pt(PointA=pt, PointB=move_5.Geometry, Unitize=False)  # -> Vector, Length
vec2pt_2 = Vector2Pt(PointA=pt, PointB=move_6.Geometry, Unitize=False)  # -> Vector, Length
move_7 = Move(Geometry=crv_2, Motion=vec2pt.Vector)  # -> graft(Geometry), Transform
move_8 = Move(Geometry=crv_3, Motion=vec2pt_2.Vector)  # -> Geometry, Transform
ln_3 = Line(StartPoint=pt, EndPoint=move_4.Geometry)
multiplication_5 = Multiplication(A=horizontal_arrays_number, B=spacing_between_columns)
ln_4 = Line(StartPoint=move.Geometry, EndPoint=move_3.Geometry)
crv_4 = Curve(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)
neg_6 = Negative(Value=multiplication_4)
series_5 = Series(Start=addition, Step=addition, Count=expr("x-1", horizontal_arrays_number))
Y_4 = UnitY(Factor=neg_3)
ln_5 = Line(StartPoint=move_6.Geometry, EndPoint=move_5.Geometry)
cir = Circle(Plane=move_5.Geometry, Radius=channel_width)
Y_5 = UnitY(Factor=neg_4)
Y_6 = UnitY(Factor=neg_5)
move_9 = Move(Geometry=[ln_5, move_7.Geometry], Motion=X_4)  # -> Geometry, Transform
move_10 = Move(Geometry=move_4.Geometry, Motion=X_5)  # -> Geometry, Transform
ln_6 = Line(StartPoint=move_2.Geometry, EndPoint=move_10.Geometry)
join = JoinCurves(Curves=[ln, ln_3], Preserve=False)
Y_7 = UnitY(Factor=neg_6)
join_2 = JoinCurves(Curves=[ln_6, ln_2], Preserve=False)
multiplication_6 = Multiplication(A="pi/2", B=channel_width)
multiplication_7 = Multiplication(A="pi/2*3", B=channel_width)
merge = Merge(Data1=ln_5, Data2=move_9.Geometry, Data3=move_7.Geometry)  # -> graft(Result)
move_11 = Move(Geometry=merge, Motion=Y_4)  # -> Geometry, Transform
X_6 = UnitX(Factor=series_5)
move_12 = Move(Geometry=move_8.Geometry, Motion=X_6)  # -> Geometry, Transform
merge_2 = Merge(Data1=move_8.Geometry, Data2=move_12.Geometry)  # -> graft(Result)
multiplication_8 = Multiplication(A=channel_width, B="2")
ln_7 = Line(StartPoint=move_10.Geometry, EndPoint=move_2.Geometry)
join_3 = JoinCurves(Curves=[ln_2, ln_7], Preserve=False)
ln_8 = Line(StartPoint=move_10.Geometry, EndPoint=move_4.Geometry)
move_13 = Move(Geometry=merge_2, Motion=Y_5)  # -> Geometry, Transform
move_14 = Move(Geometry=merge_2, Motion=Y_6)  # -> Geometry, Transform
fillet = Fillet(Curve=join_3, Radius=Slider(4, range=0..100))
fillet_2 = Fillet(Curve=join, Radius=Slider(4, range=0..100))
series_6 = Series(Start=multiplication_8, Step=multiplication_8, Count=expr("x-1", vertical_units_number))
dom = ConstructDomain(DomainStart=multiplication_6, DomainEnd=multiplication_7)
subcrv = SubCurve(BaseCurve=cir, Domain=dom)
fillet_3 = Fillet(Curve=join_2, Radius=Slider(4, range=0..10))
midpt = CurveMiddle(Curve=ln_8)
move_15 = Move(Geometry=ln_8, Motion=Y_7)  # -> Geometry, Transform
yz = YZPlane(Origin=Point(0, 0, 0))
multiplication_9 = Multiplication(A=channel_width, B="2")
crv_5 = Curve(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)
subtraction_4 = Subtraction(A=subtraction_3, B="2")
multiplication_10 = Multiplication(A=subtraction_4, B="2")
subtraction_5 = Subtraction(A=addition_2, B=multiplication_5, C=multiplication_10)
division_3 = Division(A=subtraction_5, B=subtraction_2)
addition_3 = Addition(A=division_3, B=spacing_between_columns)
neg_7 = Negative(Value=series_6)
pl_origin = PlaneOrigin(Base=yz, Origin=midpt)
X_7 = UnitX(Factor=subtraction_4)
neg_8 = Negative(Value=multiplication_9)
Y_8 = UnitY(Factor=neg_8)
yz_2 = YZPlane(Origin=Point(0, 0, 0))
Y_9 = UnitY(Factor=neg_7)
series_7 = Series(Start=addition_3, Step=addition_3, Count=expr("x-2", horizontal_arrays_number))
move_16 = Move(Geometry=subcrv, Motion=Y_9)  # -> graft(Geometry), Transform
merge_3 = Merge(Data1=subcrv, Data2=move_16.Geometry)
mirror = Mirror(Geometry=merge_3, Plane=pl_origin)  # -> Geometry, Transform
pt_2 = Point(move_6.Geometry)
pl_origin_2 = PlaneOrigin(Base=yz_2, Origin=midpt)
division_4 = Division(A=spacing_between_columns, B="2")
division_5 = Division(A=channel_width, B="2")
series_8 = Series(Start=addition_3, Step=addition_3, Count=expr("x-2", horizontal_arrays_number))
X_8 = UnitX(Factor=series_7)
Y_10 = UnitY(Factor=division_5)
series_9 = Series(Start=multiplication_2, Step=multiplication_2, Count=expr("x-2", vertical_units_number))
X_9 = UnitX(Factor=series_8)
X_10 = UnitX(Factor=spacing_between_columns)
X_11 = UnitX(Factor=division_3)

move_17 = Move(Geometry=move_4.Geometry, Motion=Y_8)  # -> Geometry, Transform
move_18 = Move(Geometry=move_17.Geometry, Motion=X_7)  # -> Geometry, Transform
move_19 = Move(Geometry=move_18.Geometry, Motion=X_10)  # -> Geometry, Transform
move_20 = Move(Geometry=move_19.Geometry, Motion=X_11)  # -> Geometry, Transform

vec2pt_3 = Vector2Pt(PointA=pt, PointB=move_18.Geometry, Unitize=False)  # -> Vector, Length
move_21 = Move(Geometry=crv, Motion=vec2pt_3.Vector)  # -> graft(Geometry), Transform
move_22 = Move(Geometry=move_21.Geometry, Motion=Y_5)  # -> Geometry, Transform
vec2pt_4 = Vector2Pt(PointA=pt, PointB=move_19.Geometry, Unitize=False)  # -> Vector, Length
move_23 = Move(Geometry=crv_4, Motion=vec2pt_4.Vector)  # -> graft(Geometry), Transform
vec2pt_5 = Vector2Pt(PointA=pt, PointB=move_20.Geometry, Unitize=False)  # -> Vector, Length
move_24 = Move(Geometry=crv_5, Motion=vec2pt_5.Vector)  # -> Geometry, Transform
ln_9 = Line(StartPoint=move_18.Geometry, EndPoint=move_17.Geometry)
mirror_2 = Mirror(Geometry=[ln_9, move_21.Geometry], Plane=pl_origin_2)  # -> Geometry, Transform

move_25 = Move(Geometry=pt_2, Motion=Y_10)  # -> Geometry, Transform
move_26 = Move(Geometry=move_25.Geometry, Motion=Y_10)  # -> Geometry, Transform

neg_9 = Negative(Value=series_9)
move_27 = Move(Geometry=move_24.Geometry, Motion=X_9)  # -> Geometry, Transform
cir_2 = Circle(Plane=move_5.Geometry, Radius=channel_width)
Y_11 = UnitY(Factor=neg_9)
multiplication_11 = Multiplication(A="3/2*pi", B=channel_width)
multiplication_12 = Multiplication(A="11/6*pi", B=channel_width)
ellipse = Ellipse(Plane=move_25.Geometry, Radius1=division_4, Radius2=division_5)  # -> Ellipse, Focus1, Focus2
ln_10 = Line(StartPoint=move_19.Geometry, EndPoint=move_20.Geometry)
move_28 = Move(Geometry=[ln_10, move_23.Geometry], Motion=X_8)  # -> Geometry, Transform
merge_4 = Merge(
    Data1=mirror_2.Geometry,
    Data2=ln_10,
    Data3=ln_9,
    Data4=move_28.Geometry,
    Data5=move_23.Geometry,
    Data6=move_27.Geometry,
    Data7=move_24.Geometry)  # -> graft(Result)
move_29 = Move(Geometry=[merge_4, move_21.Geometry], Motion=Y_11)  # -> Geometry, Transform
multiplication_13 = Multiplication(A="7/6*pi", B=channel_width)
multiplication_14 = Multiplication(A="3/2*pi", B=channel_width)
dom_2 = ConstructDomain(DomainStart=multiplication_11, DomainEnd=multiplication_12)
subcrv_2 = SubCurve(BaseCurve=cir_2, Domain=dom_2)
crv_6 = Curve(ln_9)
mirror_3 = Mirror(Geometry=move_16.Geometry, Plane=pl_origin)  # -> Geometry, Transform
dom_3 = ConstructDomain(DomainStart=multiplication_13, DomainEnd=multiplication_14)
series_10 = Series(Start=multiplication_2, Step=multiplication_2, Count=expr("x-1", vertical_units_number))
subcrv_3 = SubCurve(BaseCurve=ellipse.Ellipse, Domain="pi to 3/2*pi")
subcrv_4 = SubCurve(BaseCurve=ellipse.Ellipse, Domain="0 to pi/2")
subcrv_5 = SubCurve(BaseCurve=ellipse.Ellipse, Domain="3/2*pi to 2*pi")
subcrv_6 = SubCurve(BaseCurve=ellipse.Ellipse, Domain="pi/2 to pi")
multiplication_15 = Multiplication(A=multiplication_2, B=vertical_units_number)
addition_4 = Addition(A=subtraction, B=spacing_between_columns)
neg_10 = Negative(Value=channel_width)
X_12 = UnitX(Factor=subtraction)
X_13 = UnitX(Factor=spacing_between_columns)
subcrv_7 = SubCurve(BaseCurve=subcrv, Domain=dom_3)
neg_11 = Negative(Value=series_10)
ln_11 = Line(StartPoint=move_4.Geometry, EndPoint=move_26.Geometry)
move_30 = Move(Geometry=subcrv_2, Motion=X_12)  # -> Geometry, Transform
Y_12 = UnitY(Factor=neg_10)
series_11 = Series(Start=addition_4, Step=addition_4, Count=expr("x-2", horizontal_arrays_number))
neg_12 = Negative(Value=multiplication_15)
addition_5 = Addition(A=subtraction, B=spacing_between_columns)
move_31 = Move(Geometry=subcrv_6, Motion=X_13)  # -> Geometry, Transform
move_32 = Move(Geometry=subcrv_3, Motion=X_13)  # -> Geometry, Transform
addition_6 = Addition(A=subtraction, B=spacing_between_columns)
number_slider = Slider(0.3, range=0..1)
Y_13 = UnitY(Factor=neg_11)
merge_5 = Merge(Data1=subcrv_5, Data2=move_32.Geometry)
flip = FlipCurve(Curve=move_30.Geometry)  # -> Curve, Flag
neg_13 = Negative(Value=channel_width)
move_33 = Move(Geometry=pt_2, Motion=Y_12)  # -> Geometry, Transform
X_14 = UnitX(Factor=addition_5)
Y_14 = UnitY(Factor=neg_12)
move_34 = Move(Geometry=subcrv_7, Motion=X_14)  # -> Geometry, Transform
series_12 = Series(Start=addition_6, Step=addition_6, Count=expr("x-1", horizontal_arrays_number))
neg_14 = Negative(Value=series_12)
X_15 = UnitX(Factor=neg_14)
move_35 = Move(Geometry=mirror_3.Geometry, Motion=X_15)  # -> Geometry, Transform
X_16 = UnitX(Factor=series_11)
neg_15 = Negative(Value=subtraction_4)
Y_15 = UnitY(Factor=neg_13)
flip_2 = FlipCurve(Curve=move_34.Geometry)  # -> Curve, Flag
blendc = BlendCurve(CurveA=flip_2.Curve, CurveB=flip.Curve, BulgeA=number_slider, BulgeB=number_slider, Continuity="2")
move_36 = Move(Geometry=merge_5, Motion=Y_15)  # -> Geometry, Transform
X_17 = UnitX(Factor=neg_15)
move_37 = Move(Geometry=ln_11, Motion=Y_14)  # -> Geometry, Transform
X_18 = UnitX(Factor=series_12)
move_38 = Move(Geometry=[crv_6, move_21.Geometry], Motion=X_18)  # -> graft(Geometry), Transform
move_39 = Move(Geometry=[move_38.Geometry, crv_6], Motion=Y_5)  # -> Geometry, Transform
move_40 = Move(Geometry=[move_16.Geometry, move_37.Geometry], Motion=X_18)  # -> Geometry, Transform
move_41 = Move(Geometry=move_33.Geometry, Motion=X_17)  # -> Geometry, Transform
ln_12 = Line(StartPoint=move_33.Geometry, EndPoint=move_41.Geometry)
merge_6 = Merge(Data1=flip_2.Curve, Data2=flip.Curve, Data3=blendc)  # -> graft(Result)
merge_7 = Merge(Data1=move_36.Geometry, Data2=subcrv_4, Data3=move_31.Geometry)  # -> graft(Result)
move_42 = Move(Geometry=merge_7, Motion=X_16)  # -> graft(Geometry), Transform
move_43 = Move(Geometry=[move_42.Geometry, merge_7], Motion=Y_13)  # -> Geometry, Transform
series_13 = Series(Start=addition_6, Step=addition_6, Count=expr("x-2", horizontal_arrays_number))
pt_3 = Point(Point(0, 0, 0))
vec2pt_6 = Vector2Pt(PointA=pt_3, PointB=move_41.Geometry, Unitize=False)  # -> Vector, Length
crv_7 = Curve(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)
X_19 = UnitX(Factor=series_13)
move_44 = Move(Geometry=merge_6, Motion=X_19)  # -> Geometry, Transform
move_45 = Move(Geometry=crv_7, Motion=vec2pt_6.Vector)  # -> graft(Geometry), Transform
move_46 = Move(Geometry=[ln_12, move_45.Geometry], Motion=X_18)  # -> graft(Geometry), Transform
move_47 = Move(Geometry=[move_46.Geometry, ln_12], Motion=Y_5)  # -> Geometry, Transform
move_48 = Move(Geometry=move_45.Geometry, Motion=Y_5)  # -> Geometry, Transform
merge_8 = Merge(
    Data1=move_48.Geometry,
    Data2=move_45.Geometry,
    Data3=move_44.Geometry,
    Data4=merge_6,
    Data5=move_47.Geometry,
    Data6=move_37.Geometry,
    Data7=move_40.Geometry,
    Data8=move_35.Geometry,
    Data9=ln_9,
    Data11=merge_3,
    Data12=fillet_2,
    Data13=fillet_3,
    Data14=ln_4,
    Data15=merge,
    Data16=move_11.Geometry,
    Data17=mirror.Geometry,
    Data18=merge_2,
    Data19=move_14.Geometry,
    Data20=move_22.Geometry,
    Data21=move_21.Geometry,
    Data22=move_38.Geometry,
    Data23=move_39.Geometry,
    Data24=ln_12,
    Data25=move_46.Geometry)
