# Grasshopper definition Array Fully Connected.gh (Grasshopper 1.0.8)

# ---- group: Detailed parameter adjustment
single_column_width = Slider(54, range=0..100)
channel_width = Slider(8, range=0..100)
slit_spacing = Slider(14, range=0..100)

# ---- group: Global adjustment
vertical_units_number = Slider(4, range=0..100)
horizontal_arrays_number = Slider(3, range=0..100)

# ---- group: ignore
气口长度 = Slider(50, range=0..100)
气口宽度 = Slider(7, range=0..100)

# ----
subtraction = Subtraction(A=single_column_width, B=slit_spacing)
neg = Negative(Value=channel_width)
pt = Point(Point(0, 0, 0))
division = Division(A=气口宽度, B="2")
division_2 = Division(A=subtraction, B="2")
Y = UnitY(Factor=气口长度)
X = UnitX(Factor=气口宽度)
multiplication = Multiplication(A=horizontal_arrays_number, B=subtraction)
subtraction_2 = Subtraction(A=horizontal_arrays_number, B="1")
addition = Addition(A=subtraction, B=slit_spacing)
Y_2 = UnitY(Factor=neg)
crv = Curve(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)
crv_2 = Curve(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)
crv_3 = Curve(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)
multiplication_2 = Multiplication(A=channel_width, B="2")
subtraction_3 = Subtraction(A=division_2, B=division)
Y_3 = UnitY(Factor=气口长度)

move = Move(Geometry=pt, Motion=Y)  # -> Geometry, Transform
move_2 = Move(Geometry=pt, Motion=X)  # -> Geometry, Transform
move_3 = Move(Geometry=move_2.Geometry, Motion=Y_3)  # -> Geometry, Transform

multiplication_3 = Multiplication(A=slit_spacing, B=subtraction_2)
series = Series(Start=addition, Step=addition, Count=expr("x-1", horizontal_arrays_number))
series_2 = Series(Start=multiplication_2, Step=multiplication_2, Count=expr("x-1", vertical_units_number))
addition_2 = Addition(A=multiplication_3, B=multiplication)
ln = Line(StartPoint=move.Geometry, EndPoint=pt)
series_3 = Series(Start=multiplication_2, Step=multiplication_2, Count=expr("x-1", vertical_units_number))
neg_2 = Negative(Value=subtraction_3)
X_2 = UnitX(Factor=subtraction)
multiplication_4 = Multiplication(A=multiplication_2, B=vertical_units_number)
ln_2 = Line(StartPoint=move_2.Geometry, EndPoint=move_3.Geometry)
X_3 = UnitX(Factor=neg_2)
neg_3 = Negative(Value=series_2)
panel = Panel(multiplication_4)
neg_4 = Negative(Value=series_3)
X_4 = UnitX(Factor=series)
X_5 = UnitX(Factor=addition_2)
move_4 = Move(Geometry=pt, Motion=X_3)  # -> Geometry, Transform

move_5 = Move(Geometry=move_4.Geometry, Motion=Y_2)  # -> Geometry, Transform
move_6 = Move(Geometry=move_5.Geometry, Motion=X_2)  # -> Geometry, Transform

vec2pt = Vector2Pt(PointA=pt, PointB=move_5.Geometry, Unitize=False)  # -> Vector, Length
vec2pt_2 = Vector2Pt(PointA=pt, PointB=move_6.Geometry, Unitize=False)  # -> Vector, Length
move_7 = Move(Geometry=crv_2, Motion=vec2pt.Vector)  # -> graft(Geometry), Transform
move_8 = Move(Geometry=crv_3, Motion=vec2pt_2.Vector)  # -> Geometry, Transform
ln_3 = Line(StartPoint=pt, EndPoint=move_4.Geometry)
multiplication_5 = Multiplication(A=horizontal_arrays_number, B=slit_spacing)
ln_4 = Line(StartPoint=move.Geometry, EndPoint=move_3.Geometry)
crv_4 = Curve(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)
neg_5 = Negative(Value=multiplication_4)
series_4 = Series(Start=addition, Step=addition, Count=expr("x-1", horizontal_arrays_number))
Y_4 = UnitY(Factor=neg_3)
ln_5 = Line(StartPoint=move_6.Geometry, EndPoint=move_5.Geometry)
cir = Circle(Plane=move_5.Geometry, Radius=channel_width)
Y_5 = UnitY(Factor=neg_4)
move_9 = Move(Geometry=[ln_5, move_7.Geometry], Motion=X_4)  # -> Geometry, Transform
move_10 = Move(Geometry=move_4.Geometry, Motion=X_5)  # -> Geometry, Transform
join = JoinCurves(Curves=[ln, ln_3], Preserve=False)
Y_6 = UnitY(Factor=neg_5)
multiplication_6 = Multiplication(A="pi/2", B=channel_width)
multiplication_7 = Multiplication(A="pi/2*3", B=channel_width)
merge = Merge(Data1=ln_5, Data2=move_9.Geometry, Data3=move_7.Geometry)  # -> graft(Result)
move_11 = Move(Geometry=merge, Motion=Y_4)  # -> Geometry, Transform
X_6 = UnitX(Factor=series_4)
move_12 = Move(Geometry=move_8.Geometry, Motion=X_6)  # -> Geometry, Transform
merge_2 = Merge(Data1=move_8.Geometry, Data2=move_12.Geometry)  # -> graft(Result)
multiplication_8 = Multiplication(A=channel_width, B="2")
ln_6 = Line(StartPoint=move_10.Geometry, EndPoint=move_2.Geometry)
join_2 = JoinCurves(Curves=[ln_2, ln_6], Preserve=False)
ln_7 = Line(StartPoint=move_10.Geometry, EndPoint=move_4.Geometry)
move_13 = Move(Geometry=merge_2, Motion=Y_5)  # -> Geometry, Transform
fillet = Fillet(Curve=join_2, Radius=Slider(4, range=0..100))
fillet_2 = Fillet(Curve=join, Radius=Slider(4, range=0..100))
series_5 = Series(Start=multiplication_8, Step=multiplication_8, Count=expr("x-1", vertical_units_number))
dom = ConstructDomain(DomainStart=multiplication_6, DomainEnd=multiplication_7)
subcrv = SubCurve(BaseCurve=cir, Domain=dom)
midpt = CurveMiddle(Curve=ln_7)
move_14 = Move(Geometry=ln_7, Motion=Y_6)  # -> Geometry, Transform
yz = YZPlane(Origin=Point(0, 0, 0))
subtraction_4 = Subtraction(A=subtraction_3, B="2")
multiplication_9 = Multiplication(A=subtraction_4, B="2")
subtraction_5 = Subtraction(A=addition_2, B=multiplication_5, C=multiplication_9)
division_3 = Division(A=subtraction_5, B=subtraction_2)
addition_3 = Addition(A=division_3, B=slit_spacing)
multiplication_10 = Multiplication(A=channel_width, B="2")
crv_5 = Curve(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)
neg_6 = Negative(Value=series_5)
pl_origin = PlaneOrigin(Base=yz, Origin=midpt)
X_7 = UnitX(Factor=subtraction_4)
neg_7 = Negative(Value=multiplication_10)
Y_7 = UnitY(Factor=neg_7)
yz_2 = YZPlane(Origin=Point(0, 0, 0))
Y_8 = UnitY(Factor=neg_6)
series_6 = Series(Start=addition_3, Step=addition_3, Count=expr("x-2", horizontal_arrays_number))
move_15 = Move(Geometry=subcrv, Motion=Y_8)  # -> Geometry, Transform
merge_3 = Merge(Data1=subcrv, Data2=move_15.Geometry)
mirror = Mirror(Geometry=merge_3, Plane=pl_origin)  # -> Geometry, Transform
pl_origin_2 = PlaneOrigin(Base=yz_2, Origin=midpt)
series_7 = Series(Start=addition_3, Step=addition_3, Count=expr("x-2", horizontal_arrays_number))
X_8 = UnitX(Factor=series_6)
series_8 = Series(Start=multiplication_2, Step=multiplication_2, Count=expr("x-2", vertical_units_number))
X_9 = UnitX(Factor=series_7)
X_10 = UnitX(Factor=slit_spacing)
X_11 = UnitX(Factor=division_3)

move_16 = Move(Geometry=move_4.Geometry, Motion=Y_7)  # -> Geometry, Transform
move_17 = Move(Geometry=move_16.Geometry, Motion=X_7)  # -> Geometry, Transform
move_18 = Move(Geometry=move_17.Geometry, Motion=X_10)  # -> Geometry, Transform
move_19 = Move(Geometry=move_18.Geometry, Motion=X_11)  # -> Geometry, Transform

vec2pt_3 = Vector2Pt(PointA=pt, PointB=move_17.Geometry, Unitize=False)  # -> Vector, Length
move_20 = Move(Geometry=crv, Motion=vec2pt_3.Vector)  # -> Geometry, Transform
vec2pt_4 = Vector2Pt(PointA=pt, PointB=move_18.Geometry, Unitize=False)  # -> Vector, Length
move_21 = Move(Geometry=crv_4, Motion=vec2pt_4.Vector)  # -> graft(Geometry), Transform
vec2pt_5 = Vector2Pt(PointA=pt, PointB=move_19.Geometry, Unitize=False)  # -> Vector, Length
move_22 = Move(Geometry=crv_5, Motion=vec2pt_5.Vector)  # -> Geometry, Transform
ln_8 = Line(StartPoint=move_17.Geometry, EndPoint=move_16.Geometry)
mirror_2 = Mirror(Geometry=[ln_8, move_20.Geometry], Plane=pl_origin_2)  # -> Geometry, Transform
neg_8 = Negative(Value=series_8)
move_23 = Move(Geometry=move_22.Geometry, Motion=X_9)  # -> Geometry, Transform
Y_9 = UnitY(Factor=neg_8)
ln_9 = Line(StartPoint=move_18.Geometry, EndPoint=move_19.Geometry)
move_24 = Move(Geometry=[ln_9, move_21.Geometry], Motion=X_8)  # -> Geometry, Transform
merge_4 = Merge(
    Data1=mirror_2.Geometry,
    Data2=ln_9,
    Data3=ln_8,
    Data4=move_24.Geometry,
    Data5=move_21.Geometry,
    Data6=move_23.Geometry,
    Data7=move_22.Geometry)  # -> graft(Result)
move_25 = Move(Geometry=[merge_4, move_20.Geometry], Motion=Y_9)  # -> Geometry, Transform
merge_5 = Merge(
    Data1=merge_4,
    Data2=move_25.Geometry,
    Data3=move_14.Geometry,
    Data4=move_13.Geometry,
    Data5=move_12.Geometry,
    Data6=move_21.Geometry,
    Data7=move_11.Geometry,
    Data8=move_9.Geometry,
    Data9=ln_5,
    Data10=merge_3,
    Data11=mirror.Geometry,
    Data12=fillet_2,
    Data13=ln_4,
    Data14=fillet,
    Data15=move_7.Geometry,
    Data16=move_8.Geometry,
    Data17=move_20.Geometry)
