# Grasshopper definition Bulging_Waveform_Surface.gh (Grasshopper 1.0.8)

# ---- group: ignore
structural_units_per_cycle = Slider(2, range=0..100)

气道口长度 = Slider(58, range=0..100)
气道口宽度 = Slider(7, range=0..100)

# ---- group: Detailed parameter adjustment
major_axis_of_unit = Slider(3, range=0..100)
width_at_narrowest_point = Slider(3.3, range=0..10)
minor_axis_of_unit = Slider(2, range=0..100)

# ---- group: Global adjustment
number_of_rows = Slider(4, range=0..100)
number_of_cycles = Slider(3, range=0..100)

# ----
pt = Point(Point(0, 0, 0))
multiplication = Multiplication(A=major_axis_of_unit, B="4")
rectangle = Rectangle(Plane=PlaneXY(0, 0, 0), XSize=气道口宽度, YSize=气道口长度, Radius=0)  # -> Rectangle, Length
series = Series(Start=multiplication, Step=multiplication, Count=structural_units_per_cycle)
ellipse = Ellipse(Plane=PlaneXY(0, 0, 0), Radius1=major_axis_of_unit, Radius2=minor_axis_of_unit)  # -> Ellipse, Focus1, Focus2
pt_2 = Point(Point(0, 0, 0))
division = Division(A=width_at_narrowest_point, B="2")
subtraction = Subtraction(A=number_of_rows, B="1")
Y = UnitY(Factor=minor_axis_of_unit)
X = UnitX(Factor=major_axis_of_unit)
X_2 = UnitX(Factor=series)
multiplication_2 = Multiplication(A=major_axis_of_unit, B="4")
pt_3 = Point(Point(0, 0, 0))
neg = Negative(Value=Y)
series_2 = Series(Start=multiplication_2, Step=multiplication_2, Count=expr("x-1", structural_units_per_cycle))
Y_2 = UnitY(Factor=division)
neg_2 = Negative(Value=X)
addition = Addition(A=major_axis_of_unit, B=minor_axis_of_unit, C=width_at_narrowest_point)
move = Move(Geometry=pt_2, Motion=neg)  # -> Geometry, Transform
neg_3 = Negative(Value=Y_2)
X_3 = UnitX(Factor=series_2)
subcrv = SubCurve(BaseCurve=ellipse.Ellipse, Domain="0 to Pi")
move_2 = Move(Geometry=graft(subcrv), Motion=X_2)  # -> Geometry, Transform
move_3 = Move(Geometry=pt, Motion=neg_2)  # -> Geometry, Transform
multiplication_3 = Multiplication(A=major_axis_of_unit, B="2")
move_4 = Move(Geometry=move.Geometry, Motion=neg_3)  # -> Geometry, Transform
multiplication_4 = Multiplication(A=addition, B="2")
Y_3 = UnitY(Factor=multiplication_4)
move_5 = Move(Geometry=move_3.Geometry, Motion=Vector(0, 0, 10))  # -> Geometry, Transform
subcrv_2 = SubCurve(BaseCurve=ellipse.Ellipse, Domain="Pi to 2*Pi")
subtraction_2 = Subtraction(A=number_of_rows, B="1")
X_4 = UnitX(Factor="80")
X_5 = UnitX(Factor=multiplication_3)
ln = Line(StartPoint=move_3.Geometry, EndPoint=move_5.Geometry)
series_3 = Series(Start=multiplication_4, Step=multiplication_4, Count=number_of_rows)
move_6 = Move(Geometry=move_4.Geometry, Motion=X_4)  # -> Geometry, Transform
move_7 = Move(Geometry=subcrv_2, Motion=X_5)  # -> Geometry, Transform
move_8 = Move(Geometry=graft(move_7.Geometry), Motion=X_3)  # -> Geometry, Transform
cull_i = CullIndex(List=series_3, Indices=subtraction_2, Wrap=True)
xz = XZPlane(Origin=Point(0, 0, 0))
division_2 = Division(A=气道口宽度, B="2")
xz_2 = XZPlane(Origin=Point(0, 0, 0))
neg_4 = Negative(Value=cull_i)
pl_offset = PlaneOffset(BasePlane=xz, Offset=move_4.Geometry)
pl_offset_2 = PlaneOffset(BasePlane=xz_2, Offset=move_4.Geometry)
neg_5 = Negative(Value=division_2)
mirror = Mirror(Plane=pl_offset_2)  # -> Geometry, Transform
Y_4 = UnitY(Factor=neg_4)
X_6 = UnitX(Factor=neg_5)
division_3 = Division(A=structural_units_per_cycle, B="2")
multiplication_5 = Multiplication(A=major_axis_of_unit, B="4", C=division_3)
crv = Curve(subcrv)
crv_2 = Curve(move_7.Geometry)
crv_3 = Curve(subcrv)
crv_4 = Curve(move_7.Geometry)
X_7 = UnitX(Factor=multiplication_5)
multiplication_6 = Multiplication(A=structural_units_per_cycle, B=number_of_cycles)
subcrv_3 = SubCurve(BaseCurve=crv, Domain="2/3*pi to pi")
subcrv_4 = SubCurve(BaseCurve=crv_3, Domain="0 to 1/3*pi")
subcrv_5 = SubCurve(BaseCurve=crv_2, Domain="pi to 4/3*pi")
subcrv_6 = SubCurve(BaseCurve=crv_4, Domain="5/3*pi to 2*pi")
multiplication_7 = Multiplication(A="4", B=major_axis_of_unit, C=structural_units_per_cycle)
series_4 = Series(Start=multiplication_7, Step=multiplication_7, Count=expr("x-1", number_of_cycles))
X_8 = UnitX(Factor=series_4)
addition_2 = Addition(A=multiplication_6, B="1")
multiplication_8 = Multiplication(A="4", B=major_axis_of_unit, C=addition_2)
X_9 = UnitX(Factor=multiplication_7)
series_5 = Series(Start=multiplication_7, Step=multiplication_7, Count=expr("x-2", number_of_cycles))
X_10 = UnitX(Factor=multiplication_8)
multiplication_9 = Multiplication(A=multiplication_7, B=number_of_cycles)
move_9 = Move(Geometry=subcrv_5, Motion=X_9)  # -> Geometry, Transform
merge = Merge(Data1=move_9.Geometry, Data2=subcrv_6, Data3=move_2.Geometry, Data4=move_8.Geometry)
mirror_2 = Mirror(Geometry=merge, Plane=pl_offset)  # -> Geometry, Transform
move_10 = Move(Geometry=[mirror_2.Geometry, mirror.Geometry], Motion=Y_3)  # -> Geometry, Transform
end = EndPoints(Curve=move_10.Geometry)  # -> Start, End
move_11 = Move(Geometry=mirror_2.Geometry, Motion=X_7)  # -> Geometry, Transform
move_12 = Move(Geometry=flatten(merge), Motion=graft(X_8))  # -> Geometry, Transform
X_11 = UnitX(Factor=series_5)
xz_3 = XZPlane(Origin=Point(0, 0, 0))
xz_4 = XZPlane(Origin=Point(0, 0, 0))
move_13 = Move(Geometry=subcrv_3, Motion=X_10)  # -> Geometry, Transform
xz_5 = XZPlane(Origin=Point(0, 0, 0))
X_12 = UnitX(Factor=multiplication_9)
pl_offset_3 = PlaneOffset(BasePlane=xz_3, Offset=move_4.Geometry)
pl_offset_4 = PlaneOffset(BasePlane=xz_4, Offset=move_4.Geometry)
pl_offset_5 = PlaneOffset(BasePlane=xz_5, Offset=move_4.Geometry)
move_14 = Move(Geometry=subcrv_6, Motion=X_12)  # -> Geometry, Transform
xz_6 = XZPlane(Origin=Point(0, 0, 0))
merge_2 = Merge(Data1=merge, Data2=move_12.Geometry, Data3=move_13.Geometry, Data4=move_14.Geometry, Data5=subcrv_4, Data6=subcrv_5)
move_15 = Move(Geometry=flatten(merge_2), Motion=graft(Y_4))  # -> Geometry, Transform
move_16 = Move(Geometry=flatten(move_11.Geometry), Motion=graft(X_11))  # -> Geometry, Transform
mirror_3 = Mirror(Geometry=move_7.Geometry, Plane=pl_offset_3)  # -> Geometry, Transform
mirror_4 = Mirror(Geometry=subcrv, Plane=pl_offset_4)  # -> Geometry, Transform
mirror_5 = Mirror(Geometry=subcrv_4, Plane=pl_offset_5)  # -> Geometry, Transform
multiplication_10 = Multiplication(A="4", B=major_axis_of_unit)
division_4 = Division(A=structural_units_per_cycle, B="2")
pl_offset_6 = PlaneOffset(BasePlane=xz_6, Offset=move_4.Geometry)
multiplication_11 = Multiplication(A="4", B=major_axis_of_unit)
division_5 = Division(A=structural_units_per_cycle, B="2")
series_6 = Series(Start=multiplication_10, Step=multiplication_10, Count=division_4)
series_7 = Series(Start=multiplication_11, Step=multiplication_11, Count=expr("x-1", division_5))
multiplication_12 = Multiplication(A="4", B=major_axis_of_unit)
division_6 = Division(A=structural_units_per_cycle, B="2")
mirror_6 = Mirror(Geometry=subcrv_5, Plane=pl_offset_6)  # -> Geometry, Transform
addition_3 = Addition(A=major_axis_of_unit, B=minor_axis_of_unit, C=width_at_narrowest_point)
multiplication_13 = Multiplication(A=multiplication_12, B=division_6)
X_13 = UnitX(Factor=series_6)
move_17 = Move(Geometry=mirror_4.Geometry, Motion=X_13)  # -> Geometry, Transform
subtraction_3 = Subtraction(A=number_of_rows, B="1")
X_14 = UnitX(Factor=series_7)
move_18 = Move(Geometry=mirror_3.Geometry, Motion=X_14)  # -> Geometry, Transform
multiplication_14 = Multiplication(A=addition_3, B="2")
Y_5 = UnitY(Factor=multiplication_14)
subtraction_4 = Subtraction(A=number_of_rows, B="2")
X_15 = UnitX(Factor=multiplication_13)
move_19 = Move(Geometry=mirror_6.Geometry, Motion=X_15)  # -> Geometry, Transform
series_8 = Series(Start=multiplication_14, Step=multiplication_14, Count=expr("x-1", number_of_rows))
addition_4 = Addition(A=major_axis_of_unit, B=minor_axis_of_unit, C=width_at_narrowest_point)
move_20 = Move(Geometry=[mirror_2.Geometry, mirror.Geometry], Motion=Y_5)  # -> Geometry, Transform
merge_3 = Merge(Data1=move_19.Geometry, Data2=move_17.Geometry, Data3=move_18.Geometry, Data4=mirror_5.Geometry, Data5=mirror_3.Geometry)
crv_5 = Curve(move_13.Geometry)
crv_6 = Curve(subcrv_4)
crv_7 = Curve(mirror_5.Geometry)
cull_i_2 = CullIndex(List=series_8, Indices=subtraction_4, Wrap=True)
yz = YZPlane(Origin=Point(0, 0, 0))
multiplication_15 = Multiplication(A=addition_4, B="2", C=subtraction_3)
crv_8 = Curve(mirror_4.Geometry)
end_2 = EndPoints(Curve=move_20.Geometry)  # -> Start, End
end_3 = EndPoints(Curve=crv_6)  # -> Start, End
end_4 = EndPoints(Curve=crv_5)  # -> Start, End
neg_6 = Negative(Value=cull_i_2)
neg_7 = Negative(Value=multiplication_15)
Y_6 = UnitY(Factor=neg_6)
ln_2 = Line(StartPoint=end_3.End, EndPoint=end_4.Start)
Y_7 = UnitY(Factor=neg_7)
move_21 = Move(Geometry=crv_7, Motion=Y_7)  # -> Geometry, Transform
midpt = CurveMiddle(Curve=ln_2)
vec2pt = Vector2Pt(PointA=pt_3, PointB=midpt, Unitize=False)  # -> Vector, Length
move_22 = Move(Geometry=rectangle.Rectangle, Motion=vec2pt.Vector)  # -> Geometry, Transform
move_23 = Move(Geometry=move_22.Geometry, Motion=X_6)  # -> Geometry, Transform
pl_origin = PlaneOrigin(Base=yz, Origin=midpt)
mirror_7 = Mirror(Geometry=merge_3, Plane=pl_origin)  # -> Geometry, Transform
merge_4 = Merge(Data1=mirror_7.Geometry, Data2=merge_3, Data3=move_11.Geometry, Data4=move_16.Geometry)
move_24 = Move(Geometry=flatten(merge_4), Motion=graft(Y_6))  # -> Geometry, Transform
Y_8 = UnitY(Factor=width_at_narrowest_point)
yz_2 = YZPlane(Origin=Point(0, 0, 0))
addition_5 = Addition(A=major_axis_of_unit, B=minor_axis_of_unit, C=width_at_narrowest_point)
addition_6 = Addition(A=major_axis_of_unit, B=minor_axis_of_unit, C=width_at_narrowest_point)
crv_9 = Curve(mirror_3.Geometry)
crv_10 = Curve(mirror_3.Geometry)
end_5 = EndPoints(Curve=move_21.Geometry)  # -> Start, End
pl_origin_2 = PlaneOrigin(Base=yz_2, Origin=midpt)
move_25 = Move(Geometry=ln_2, Motion=Y_8)  # -> Geometry, Transform
multiplication_16 = Multiplication(A=addition_5, B="2", C=subtraction_3)
multiplication_17 = Multiplication(A=addition_6, B="2", C=subtraction_3)
mirror_8 = Mirror(Geometry=move_21.Geometry, Plane=pl_origin_2)  # -> Geometry, Transform
addition_7 = Addition(A=major_axis_of_unit, B=minor_axis_of_unit, C=width_at_narrowest_point)
addition_8 = Addition(A=major_axis_of_unit, B=minor_axis_of_unit, C=width_at_narrowest_point)
end_6 = EndPoints(Curve=move_25.Geometry)  # -> Start, End
neg_8 = Negative(Value=multiplication_16)
neg_9 = Negative(Value=multiplication_17)
addition_9 = Addition(A=major_axis_of_unit, B=minor_axis_of_unit, C=width_at_narrowest_point)
Y_9 = UnitY(Factor=neg_8)
move_26 = Move(Geometry=crv_8, Motion=Y_9)  # -> Geometry, Transform
multiplication_18 = Multiplication(A=addition_7, B="2")
multiplication_19 = Multiplication(A=addition_8, B="2")
Y_10 = UnitY(Factor=neg_9)
move_27 = Move(Geometry=[crv_10, mirror_3.Geometry], Motion=Y_10)  # -> Geometry, Transform
end_7 = EndPoints(Curve=mirror_8.Geometry)  # -> Start, End
multiplication_20 = Multiplication(A=addition_9, B="2")
multiplication_21 = Multiplication(A=structural_units_per_cycle, B=number_of_cycles)
multiplication_22 = Multiplication(A="4", B=major_axis_of_unit)
multiplication_23 = Multiplication(A=multiplication_18, B=number_of_rows)
multiplication_24 = Multiplication(A=multiplication_19, B=number_of_rows)
multiplication_25 = Multiplication(A=multiplication_20, B=number_of_rows)
Y_11 = UnitY(Factor=multiplication_23)
Y_12 = UnitY(Factor=multiplication_24)
series_9 = Series(Start=multiplication_22, Step=multiplication_22, Count=multiplication_21)
move_28 = Move(Geometry=end_5.End, Motion=Y_12)  # -> Geometry, Transform
Y_13 = UnitY(Factor=multiplication_25)
X_16 = UnitX(Factor=series_9)
move_29 = Move(Geometry=graft([move_27.Geometry, move_26.Geometry]), Motion=X_16)  # -> Geometry, Transform
merge_5 = Merge(Data1=mirror_8.Geometry, Data2=move_29.Geometry, Data3=move_21.Geometry, Data4=move_27.Geometry)
move_30 = Move(Geometry=merge_5, Motion=Y_11)  # -> Geometry, Transform
move_31 = Move(Geometry=end_7.End, Motion=Y_13)  # -> Geometry, Transform
ln_3 = Line(StartPoint=end_5.End, EndPoint=move_28.Geometry)
ln_4 = Line(StartPoint=end_7.End, EndPoint=move_31.Geometry)
boundary = BoundarySurfaces(Edges=flatten([merge_5, ln_4, move_30.Geometry, ln_3]))
addition_10 = Addition(A=major_axis_of_unit, B=minor_axis_of_unit, C=width_at_narrowest_point)
panel = Panel(addition_10)
multiplication_26 = Multiplication(A=addition_10, B=subtraction, C="2")
multiplication_27 = Multiplication(A=width_at_narrowest_point, B="2")
multiplication_28 = Multiplication(A=minor_axis_of_unit, B="2")
addition_11 = Addition(A=multiplication_26, B=multiplication_27, C=multiplication_28)
neg_10 = Negative(Value=addition_11)
Y_14 = UnitY(Factor=neg_10)
move_32 = Move(Geometry=move_25.Geometry, Motion=Y_14)  # -> Geometry, Transform
end_8 = EndPoints(Curve=move_32.Geometry)  # -> Start, End
ln_5 = Line(StartPoint=end_6.Start, EndPoint=end_8.Start)
ln_6 = Line(StartPoint=end_6.End, EndPoint=end_8.End)
boundary_2 = BoundarySurfaces(Edges=[move_25.Geometry, ln_5, move_32.Geometry, ln_6])
sunion = SolidUnion(Breps=[move_23.Geometry, boundary_2])
edges = BrepEdges(Brep=sunion)  # -> Naked, Interior, NonManifold
crv_11 = Curve(edges.Naked)
join = JoinCurves(Curves=crv_11, Preserve=False)
fillet = Fillet(Curve=join, Radius=Slider(1, range=0..1))
merge_6 = Merge(Data1=fillet, Data2=move_24.Geometry, Data3=merge_4, Data4=merge_2, Data5=move_15.Geometry)
