# Grasshopper definition Parallel_Wavy_Line_Surface.gh (Grasshopper 1.0.8)

# ---- group: Detailed parameter adjustment
channel_width = Slider(8, range=0..100)
slit_spacing = Slider(14, range=0..100)

# ---- group: ignore
气口宽度 = Slider(6, range=0..100)
气口长度 = Slider(45, range=0..100)
气囊总宽度 = Slider(80, range=0..100)
气囊总长度 = Slider(62, range=0..100)

# ----
crv = Curve(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)
rectangle = Rectangle(Plane=PlaneXY(0, 0, 0), XSize=气囊总宽度, YSize=气囊总长度, Radius=0)  # -> Rectangle, Length
rectangle_2 = Rectangle(Plane=PlaneXY(0, 0, 0), XSize=气口宽度, YSize=气口长度, Radius=0)  # -> Rectangle, Length
multiplication = Multiplication(A=channel_width, B="2")
Y = UnitY(Factor=气囊总长度)
fillet = Fillet(Curve=rectangle.Rectangle, Radius="1")
subtraction = Subtraction(A=气囊总宽度, B=气口宽度)
integer_division = IntegerDivision(A=气囊总长度, B=multiplication)
move = Move(Geometry=crv, Motion=Y)  # -> Geometry, Transform
neg = Negative(Value=channel_width)
division = Division(A=subtraction, B="2")
addition = Addition(A=integer_division, B="1")
Y_2 = UnitY(Factor=neg)
X = UnitX(Factor=division)
move_2 = Move(Geometry=rectangle_2.Rectangle, Motion=X)  # -> Geometry, Transform
series = Series(Start=multiplication, Step=multiplication, Count=expr("x+1", integer_division))
move_3 = Move(Geometry=move.Geometry, Motion=Y_2)  # -> Geometry, Transform
series_2 = Series(Start=multiplication, Step=multiplication, Count=addition)
neg_2 = Negative(Value=series_2)
subtraction_2 = Subtraction(A=气囊总长度, B="2")
neg_3 = Negative(Value=series)
Y_3 = UnitY(Factor=neg_2)
Y_4 = UnitY(Factor=subtraction_2)
Y_5 = UnitY(Factor=neg_3)
panel = Panel(series_2)
move_4 = Move(Geometry=move_3.Geometry, Motion=Y_5)  # -> Geometry, Transform
move_5 = Move(Geometry=move.Geometry, Motion=Y_3)  # -> Geometry, Transform
move_6 = Move(Geometry=move_2.Geometry, Motion=Y_4)  # -> Geometry, Transform
merge = Merge(Data1=move_3.Geometry, Data2=move_4.Geometry)  # -> flatten(Result)
merge_2 = Merge(Data1=move.Geometry, Data2=move_5.Geometry)  # -> flatten(Result)
sunion = SolidUnion(Breps=[fillet, move_6.Geometry])
edges = BrepEdges(Brep=sunion)  # -> Naked, Interior, NonManifold
crv_2 = Curve(edges.Naked)
join = JoinCurves(Curves=crv_2, Preserve=False)
divide = DivideCurve(Curve=merge_2, Count=slit_spacing, Kinks=False)  # -> Points, Tangents, Parameters
divide_2 = DivideCurve(Curve=merge, Count=slit_spacing, Kinks=False)  # -> Points, Tangents, Parameters
fillet_2 = Fillet(Curve=join, Radius=Slider(1, range=0..100))
shatter = Shatter(Curve=merge_2, Parameters=divide.Parameters)
shatter_2 = Shatter(Curve=merge, Parameters=divide_2.Parameters)
panel_2 = Panel("""1
1
1
0
1
1
1
1""")
panel_3 = Panel("""1
1
1
1
1
1
1
0""")
cull = CullPattern(List=shatter_2, CullPattern=panel_3)
cull_2 = CullPattern(List=shatter, CullPattern=panel_2)
merge_3 = Merge(Data1=cull, Data2=cull_2)  # -> simplify(Result)

trim = TrimTree(Tree=merge_3, Depth=1)
branch = TreeBranch(Tree=trim, Path="{0}", MaintainPaths=True)
join_2 = JoinCurves(Curves=branch, Preserve=False)
ccx = CurveCurve(CurveA=join_2, CurveB=fillet)  # -> Points, ParamsA, ParamsB
lng = ListLength(List=ccx.Points)  # -> flatten(Length)
shatter_3 = Shatter(Curve=graft(join_2), Parameters=ccx.ParamsA)
dispatch = Dispatch(List=join_2, DispatchPattern=lng)  # -> ListA, ListB

panel_4 = Panel(lng)
crv_3 = Curve(dispatch.ListB)

midpt = CurveMiddle(Curve=[shatter_3, crv_3])
incurve = PointInCurve(Point=midpt, Curve=fillet)  # -> Relationship, Point
dispatch_2 = Dispatch(List=[shatter_3, crv_3], DispatchPattern=incurve.Relationship)  # -> ListA, ListB
crv_4 = Curve(dispatch_2.ListA)

merge_4 = Merge(Data1=crv_4, Data2=fillet_2)
