# Grasshopper definition Single_Bulging_Wave_Line_1.gh (Grasshopper 1.0.8)

# ---- group: ignore
气道口长度 = Slider(40, range=0..100)

# ---- group: Detailed parameter adjustment
width_at_narrowest_point = Slider(3.4, range=0..10)
major_axis_of_unit = Slider(5, range=0..100)
minor_axis_of_unit = Slider(3, range=0..100)

# ---- group: Global adjustment
number_of_units = Slider(8, range=0..100)

# ----
pt = Point(Point(0, 0, 0))
multiplication = Multiplication(A=minor_axis_of_unit, B="2")
multiplication_2 = Multiplication(A=major_axis_of_unit, B="4")
series = Series(Start=multiplication_2, Step=multiplication_2, Count=number_of_units)
ellipse = Ellipse(Plane=PlaneXY(0, 0, 0), Radius1=major_axis_of_unit, Radius2=minor_axis_of_unit)  # -> Ellipse, Focus1, Focus2
pt_2 = Point(Point(0, 0, 0))
division = Division(A=width_at_narrowest_point, B="2")
Y = UnitY(Factor=minor_axis_of_unit)
addition = Addition(A=multiplication, B=width_at_narrowest_point)
multiplication_3 = Multiplication(A=major_axis_of_unit, B="4")
X = UnitX(Factor=major_axis_of_unit)
X_2 = UnitX(Factor=series)
neg = Negative(Value=Y)
addition_2 = Addition(A=number_of_units, B="1")
Y_2 = UnitY(Factor=division)
Y_3 = UnitY(Factor=addition)
neg_2 = Negative(Value=X)
move = Move(Geometry=pt_2, Motion=neg)  # -> Geometry, Transform
multiplication_4 = Multiplication(A=multiplication_3, B=addition_2)
neg_3 = Negative(Value=Y_2)
subcrv = SubCurve(BaseCurve=ellipse.Ellipse, Domain="0 to Pi")
neg_4 = Negative(Value=Y_3)
X_3 = UnitX(Factor=气道口长度)
X_4 = UnitX(Factor=multiplication_4)
move_2 = Move(Geometry=pt, Motion=neg_2)  # -> Geometry, Transform
multiplication_5 = Multiplication(A=major_axis_of_unit, B="2")
move_3 = Move(Geometry=move.Geometry, Motion=neg_3)  # -> Geometry, Transform
move_4 = Move(Geometry=move_2.Geometry, Motion=neg_4)  # -> Geometry, Transform
move_5 = Move(Geometry=[move_2.Geometry, move_4.Geometry], Motion=X_4)  # -> Geometry, Transform
subcrv_2 = SubCurve(BaseCurve=ellipse.Ellipse, Domain="Pi to 2*Pi")
X_5 = UnitX(Factor="80")
X_6 = UnitX(Factor=multiplication_5)
ln = Line(StartPoint=move_2.Geometry, EndPoint=move_4.Geometry)
move_6 = Move(Geometry=move_3.Geometry, Motion=X_5)  # -> Geometry, Transform
move_7 = Move(Geometry=subcrv_2, Motion=X_6)  # -> Geometry, Transform
move_8 = Move(Geometry=graft([move_7.Geometry, subcrv]), Motion=X_2)  # -> Geometry, Transform
move_9 = Move(Geometry=move_5.Geometry, Motion=X_3)  # -> Geometry, Transform
move_10 = Move(Geometry=ln, Motion=X_4)  # -> Geometry, Transform
xz = XZPlane(Origin=Point(0, 0, 0))
ln_2 = Line(StartPoint=move_5.Geometry, EndPoint=move_9.Geometry)
pl_offset = PlaneOffset(BasePlane=xz, Offset=move_3.Geometry)
move_11 = Move(Geometry=move_10.Geometry, Motion=X_3)  # -> Geometry, Transform
mirror = Mirror(Geometry=[move_8.Geometry, move_7.Geometry, subcrv], Plane=pl_offset)  # -> Geometry, Transform
merge = Merge(
    Data1=move_7.Geometry,
    Data2=mirror.Geometry,
    Data3=move_11.Geometry,
    Data4=ln_2,
    Data5=move_8.Geometry,
    Data6=subcrv,
    Data7=ln)
