# Grasshopper definition Single_Bulging_Wave_Line_2.gh (Grasshopper 1.0.8)

# ---- group: ignore
气道口长度 = Slider(40, range=0..100)

# ---- group: Global adjustment
number_of_units = Slider(7, range=0..100)

# ---- group: Detailed parameter adjustment
major_axis_of_indentation = Slider(2, range=0..10)
minor_axis_of_indentation = Slider(0.9, range=0..10)
major_axis_of_protrusion = Slider(8, range=0..100)
minor_axis_of_protrusion = Slider(6, range=0..100)
width_at_narrowest_point = Slider(0.6, range=0..10)

# ----
multiplication = Multiplication(A=major_axis_of_indentation, B="2")
pt = Point(Point(0, 0, 0))
multiplication_2 = Multiplication(A=minor_axis_of_protrusion, B="2")
multiplication_3 = Multiplication(A=major_axis_of_protrusion, B="2")
multiplication_4 = Multiplication(A=major_axis_of_indentation, B="2")
ellipse = Ellipse(Plane=PlaneXY(0, 0, 0), Radius1=major_axis_of_protrusion, Radius2=minor_axis_of_protrusion)  # -> Ellipse, Focus1, Focus2
pt_2 = Point(Point(0, 0, 0))
addition = Addition(A=major_axis_of_indentation, B=major_axis_of_protrusion)
division = Division(A=width_at_narrowest_point, B="2")
Y = UnitY(Factor=minor_axis_of_protrusion)
ellipse_2 = Ellipse(Plane=PlaneXY(0, 0, 0), Radius1=major_axis_of_indentation, Radius2=minor_axis_of_indentation)  # -> Ellipse, Focus1, Focus2
addition_2 = Addition(A=multiplication_2, B=width_at_narrowest_point)
multiplication_5 = Multiplication(A=major_axis_of_protrusion, B="2")
addition_3 = Addition(A=multiplication_5, B=multiplication)
addition_4 = Addition(A=multiplication_3, B=multiplication_4)
series = Series(Start=addition_4, Step=addition_4, Count=number_of_units)
X = UnitX(Factor=major_axis_of_protrusion)
X_2 = UnitX(Factor=series)
neg = Negative(Value=Y)
addition_5 = Addition(A=number_of_units, B="1")
Y_2 = UnitY(Factor=division)
Y_3 = UnitY(Factor=addition_2)
X_3 = UnitX(Factor=addition)
neg_2 = Negative(Value=X)
multiplication_6 = Multiplication(A=addition_3, B=addition_5)
move = Move(Geometry=pt_2, Motion=neg)  # -> Geometry, Transform
neg_3 = Negative(Value=Y_2)
subcrv = SubCurve(BaseCurve=ellipse.Ellipse, Domain="0 to Pi")
neg_4 = Negative(Value=Y_3)
subcrv_2 = SubCurve(BaseCurve=ellipse_2.Ellipse, Domain="Pi to 2*Pi")
move_2 = Move(Geometry=subcrv_2, Motion=X_3)  # -> Geometry, Transform
move_3 = Move(Geometry=graft([subcrv, move_2.Geometry]), Motion=X_2)  # -> Geometry, Transform
X_4 = UnitX(Factor=气道口长度)
X_5 = UnitX(Factor=multiplication_6)
move_4 = Move(Geometry=pt, Motion=neg_2)  # -> Geometry, Transform
multiplication_7 = Multiplication(A=major_axis_of_protrusion, B="2")
move_5 = Move(Geometry=move.Geometry, Motion=neg_3)  # -> Geometry, Transform
move_6 = Move(Geometry=move_4.Geometry, Motion=neg_4)  # -> Geometry, Transform
move_7 = Move(Geometry=[move_4.Geometry, move_6.Geometry], Motion=X_5)  # -> Geometry, Transform
X_6 = UnitX(Factor="80")
X_7 = UnitX(Factor=multiplication_7)
ln = Line(StartPoint=move_4.Geometry, EndPoint=move_6.Geometry)
move_8 = Move(Geometry=move_5.Geometry, Motion=X_6)  # -> Geometry, Transform
move_9 = Move(Geometry=move_7.Geometry, Motion=X_4)  # -> Geometry, Transform
move_10 = Move(Geometry=ln, Motion=X_5)  # -> Geometry, Transform
xz = XZPlane(Origin=Point(0, 0, 0))
ln_2 = Line(StartPoint=move_7.Geometry, EndPoint=move_9.Geometry)
pl_offset = PlaneOffset(BasePlane=xz, Offset=move_5.Geometry)
move_11 = Move(Geometry=move_10.Geometry, Motion=X_4)  # -> Geometry, Transform
mirror = Mirror(Geometry=[move_3.Geometry, subcrv, move_2.Geometry], Plane=pl_offset)  # -> Geometry, Transform
merge = Merge(
    Data1=move_2.Geometry,
    Data2=subcrv,
    Data3=move_3.Geometry,
    Data4=mirror.Geometry,
    Data5=ln_2,
    Data6=move_11.Geometry,
    Data7=ln)
