# Grasshopper definition Single_Wavy_Line.gh (Grasshopper 1.0.8)

# ---- group: Detailed parameter adjustment
amplitude = Slider(29, range=0..100)
secondary_width_adjustment_parameter = Slider(10, range=0..100)
primary_width_adjustment_parameter = Slider(17, range=0..100)

# ---- group: Global adjustment
number_of_cycles = Slider(5, range=0..100)

# ---- group: ignore
最小缝隙 = Slider(2.5, range=0..100)

# ----
multiplication = Multiplication(A=primary_width_adjustment_parameter, B="pi")
multiplication_2 = Multiplication(A=primary_width_adjustment_parameter, B="2*pi")
multiplication_3 = Multiplication(A=secondary_width_adjustment_parameter, B="pi")
cir = Circle(Plane=PlaneXY(0, 0, 0), Radius=secondary_width_adjustment_parameter)
dom = ConstructDomain(DomainStart="0", DomainEnd=multiplication_3)
cir_2 = Circle(Plane=PlaneXY(0, 0, 0), Radius=primary_width_adjustment_parameter)
dom_2 = ConstructDomain(DomainStart=multiplication, DomainEnd=multiplication_2)
subtraction = Subtraction(A=primary_width_adjustment_parameter, B=secondary_width_adjustment_parameter)
neg = Negative(Value=amplitude)
subcrv = SubCurve(BaseCurve=cir, Domain=dom)
subcrv_2 = SubCurve(BaseCurve=cir_2, Domain=dom_2)
X = UnitX(Factor=primary_width_adjustment_parameter)
multiplication_4 = Multiplication(A=subtraction, B="2")
Y = UnitY(Factor=neg)
move = Move(Geometry=subcrv_2, Motion=X)  # -> Geometry, Transform
addition = Addition(A=primary_width_adjustment_parameter, B=primary_width_adjustment_parameter, C=最小缝隙)
addition_2 = Addition(A=multiplication_4, B=最小缝隙, C=secondary_width_adjustment_parameter, D=secondary_width_adjustment_parameter)
move_2 = Move(Geometry=move.Geometry, Motion=Y)  # -> Geometry, Transform
series = Series(Start=addition_2, Step=addition_2, Count=number_of_cycles)
series_2 = Series(Start=addition, Step=addition, Count=number_of_cycles)
X_2 = UnitX(Factor=series)
X_3 = UnitX(Factor=series_2)
subtraction_2 = Subtraction(A=number_of_cycles, B="1")
move_3 = Move(Geometry=subcrv, Motion=X_2)  # -> Geometry, Transform
move_4 = Move(Geometry=move_2.Geometry, Motion=X_3)  # -> Geometry, Transform
end = EndPoints(Curve=move_3.Geometry)  # -> Start, End
end_2 = EndPoints(Curve=move_4.Geometry)  # -> Start, End
cull_i = CullIndex(List=end_2.End, Indices=subtraction_2, Wrap=True)
ln = Line(StartPoint=end.Start, EndPoint=end_2.Start)
cull_i_2 = CullIndex(List=end.End, Indices="0", Wrap=True)
ln_2 = Line(StartPoint=cull_i_2, EndPoint=cull_i)
join = JoinCurves(Curves=[ln, move_3.Geometry], Preserve=False)
fillet = Fillet(Curve=join, Radius=Slider(7, range=0..10))
join_2 = JoinCurves(Curves=[fillet, ln_2], Preserve=False)
fillet_2 = Fillet(Curve=join_2, Radius=Slider(9, range=0..10))
join_3 = JoinCurves(Curves=flatten([fillet_2, move_4.Geometry]), Preserve=False)
fillet_3 = Fillet(Curve=join_3, Radius=Slider(10, range=0..10))
subtraction_3 = Subtraction(A=primary_width_adjustment_parameter, B=secondary_width_adjustment_parameter)
crv = Curve(fillet_3)
offset = OffsetCurve(Curve=crv, Distance=subtraction_3, Corners=1)
neg_2 = Negative(Value=subtraction_3)
end_3 = EndPoints(Curve=crv)  # -> Start, End
end_4 = EndPoints(Curve=offset)  # -> Start, End
Y_2 = UnitY(Factor=neg_2)
ln_3 = Line(StartPoint=end_3.End, EndPoint=end_4.End)
merge = Merge(Data1=offset, Data2=crv, Data3=ln_3)
move_5 = Move(Geometry=end_3.Start, Motion=Y_2)  # -> Geometry, Transform
neg_3 = Negative(Value="50")
neg_4 = Negative(Value="50")
X_4 = UnitX(Factor=neg_3)
move_6 = Move(Geometry=end_3.Start, Motion=X_4)  # -> Geometry, Transform
ln_4 = Line(StartPoint=move_5.Geometry, EndPoint=end_3.Start)
X_5 = UnitX(Factor=neg_4)
ln_5 = Line(StartPoint=move_6.Geometry, EndPoint=end_4.Start)
Y_3 = UnitY(Factor="5")
move_7 = Move(Geometry=move_5.Geometry, Motion=X_5)  # -> Geometry, Transform
ln_6 = Line(StartPoint=move_7.Geometry, EndPoint=move_5.Geometry)
join_4 = JoinCurves(Curves=[ln_6, ln_4], Preserve=False)
move_8 = Move(Geometry=move_6.Geometry, Motion=Y_3)  # -> Geometry, Transform
ln_7 = Line(StartPoint=move_6.Geometry, EndPoint=move_8.Geometry)
fillet_4 = Fillet(Curve=join_4, Radius=Slider(7, range=0..10))
neg_5 = Negative(Value="5")
neg_6 = Negative(Value="20")
Y_4 = UnitY(Factor=neg_5)
neg_7 = Negative(Value="20")
move_9 = Move(Geometry=move_7.Geometry, Motion=Y_4)  # -> Geometry, Transform
X_6 = UnitX(Factor=neg_6)
X_7 = UnitX(Factor=neg_7)
ln_8 = Line(StartPoint=move_9.Geometry, EndPoint=move_7.Geometry)
move_10 = Move(Geometry=move_8.Geometry, Motion=X_6)  # -> Geometry, Transform
ln_9 = Line(StartPoint=move_10.Geometry, EndPoint=move_8.Geometry)
move_11 = Move(Geometry=move_9.Geometry, Motion=X_7)  # -> Geometry, Transform
ln_10 = Line(StartPoint=move_11.Geometry, EndPoint=move_10.Geometry)
ln_11 = Line(StartPoint=move_9.Geometry, EndPoint=move_11.Geometry)
merge_2 = Merge(Data1=ln_11, Data2=ln_8, Data3=ln_10, Data4=ln_9, Data5=ln_7, Data6=ln_5, Data7=fillet_4, Data8=merge)
