# Grasshopper definition Tween_Curve_Surface.gh (Grasshopper 1.0.8)

# ---- group: Detailed parameter adjustment
slit_spacing = Slider(16, range=0..100)
uniform_channel_division = Slider(12, range=0..100)

# ---- group: ignore
线之间的间距 = Slider(29, range=0..100)

气口长度 = Slider(45, range=0..100)
气口宽度 = Slider(6, range=0..100)
气囊总宽度 = Slider(80, range=0..100)
气囊总长度 = Slider(69, range=0..100)

# ----
pt = Point(Point(0, 0, 0))
crv = Curve(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)
rectangle = Rectangle(Plane=PlaneXY(0, 0, 0), XSize=气囊总宽度, YSize=气囊总长度, Radius=0)  # -> Rectangle, Length
rectangle_2 = Rectangle(Plane=PlaneXY(0, 0, 0), XSize=气口宽度, YSize=气口长度, Radius=0)  # -> Rectangle, Length
multiplication = Multiplication(A=线之间的间距, B="2")
Y = UnitY(Factor=气囊总长度)
Y_2 = UnitY(Factor="5")
Y_3 = UnitY(Factor=气囊总长度)
fillet = Fillet(Curve=rectangle.Rectangle, Radius="1")
subtraction = Subtraction(A=气囊总宽度, B=气口宽度)
integer_division = IntegerDivision(A=气囊总长度, B=multiplication)
move = Move(Motion=Y)  # -> Geometry, Transform
move_2 = Move(Geometry=crv, Motion=Y_2)  # -> Geometry, Transform
move_3 = Move(Geometry=pt, Motion=Y_3)  # -> Geometry, Transform
neg = Negative(Value=线之间的间距)
division = Division(A=subtraction, B="2")
addition = Addition(A=integer_division, B="1")
ln = Line(StartPoint=move_3.Geometry, EndPoint=pt)
Y_4 = UnitY(Factor=neg)
X = UnitX(Factor=division)
move_4 = Move(Geometry=rectangle_2.Rectangle, Motion=X)  # -> Geometry, Transform
series = Series(Start=multiplication, Step=multiplication, Count=expr("x+1", integer_division))
move_5 = Move(Geometry=move.Geometry, Motion=Y_4)  # -> Geometry, Transform
series_2 = Series(Start=multiplication, Step=multiplication, Count=addition)
neg_2 = Negative(Value=series_2)
midpt = CurveMiddle(Curve=ln)
subtraction_2 = Subtraction(A=气囊总长度, B="2")
neg_3 = Negative(Value=series)
Y_5 = UnitY(Factor=neg_2)
xz = XZPlane(Origin=Point(0, 0, 0))
Y_6 = UnitY(Factor=subtraction_2)
Y_7 = UnitY(Factor=neg_3)
panel = Panel(series_2)
pl_origin = PlaneOrigin(Base=xz, Origin=midpt)
move_6 = Move(Geometry=move_5.Geometry, Motion=Y_7)  # -> Geometry, Transform
range = Range(Domain=Domain(0, 1), Steps=uniform_channel_division)
move_7 = Move(Geometry=move.Geometry, Motion=Y_5)  # -> Geometry, Transform
move_8 = Move(Geometry=move_4.Geometry, Motion=Y_6)  # -> Geometry, Transform
merge = Merge(Data1=move_5.Geometry, Data2=move_6.Geometry)  # -> flatten(Result)
merge_2 = Merge(Data1=move.Geometry, Data2=move_7.Geometry)  # -> flatten(Result)
mirror = Mirror(Geometry=move_2.Geometry, Plane=pl_origin)  # -> Geometry, Transform
crv_2 = Curve(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)
crv_3 = Curve(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)
sunion = SolidUnion(Breps=[fillet, move_8.Geometry])
tweencrv = TweenCurve(CurveA=crv_3, CurveB=crv_2, Factor=range, BlendType=0)
edges = BrepEdges(Brep=sunion)  # -> Naked, Interior, NonManifold
crv_4 = Curve(edges.Naked)
join = JoinCurves(Curves=crv_4, Preserve=False)
divide = DivideCurve(Curve=merge_2, Count=slit_spacing, Kinks=False)  # -> Points, Tangents, Parameters
divide_2 = DivideCurve(Curve=merge, Count=slit_spacing, Kinks=False)  # -> Points, Tangents, Parameters
dispatch = Dispatch(List=tweencrv, DispatchPattern=[True, False])  # -> ListA, ListB
dispatch_2 = Dispatch(List=tweencrv, DispatchPattern=[True, False])  # -> ListA, ListB
fillet_2 = Fillet(Curve=join, Radius=Slider(1, range=0..100))
shatter = Shatter(Curve=merge_2, Parameters=divide.Parameters)
divide_3 = DivideCurve(Curve=dispatch_2.ListB, Count=slit_spacing, Kinks=False)  # -> Points, Tangents, Parameters
panel_2 = Panel("""1
1
1
1
1
0""")
divide_4 = DivideCurve(Curve=dispatch.ListA, Count=slit_spacing, Kinks=False)  # -> Points, Tangents, Parameters
shatter_2 = Shatter(Curve=merge, Parameters=divide_2.Parameters)
panel_3 = Panel("""1
0
1
1
1
1""")
shatter_3 = Shatter(Curve=dispatch.ListA, Parameters=divide_4.Parameters)
shatter_4 = Shatter(Curve=dispatch_2.ListB, Parameters=divide_3.Parameters)
cull = CullPattern(List=shatter_2, CullPattern=panel_3)
cull_2 = CullPattern(List=shatter, CullPattern=panel_2)
cull_3 = CullPattern(List=shatter_3, CullPattern=panel_2)
cull_4 = CullPattern(List=shatter_4, CullPattern=panel_3)
merge_3 = Merge(Data1=cull_3, Data2=cull_4)  # -> simplify(Result)

trim = TrimTree(Tree=merge_3, Depth=1)
branch = TreeBranch(Tree=trim, Path="{0}", MaintainPaths=True)
join_2 = JoinCurves(Curves=branch, Preserve=False)
ccx = CurveCurve(CurveA=join_2, CurveB=fillet)  # -> Points, ParamsA, ParamsB
lng = ListLength(List=ccx.Points)  # -> flatten(Length)
shatter_5 = Shatter(Curve=graft(join_2), Parameters=ccx.ParamsA)
dispatch_3 = Dispatch(List=join_2, DispatchPattern=lng)  # -> ListA, ListB
merge_4 = Merge(Data1=flatten(shatter_5), Data2=dispatch_3.ListB)  # -> flatten(Result)
midpt_2 = CurveMiddle(Curve=merge_4)
incurve = PointInCurve(Point=midpt_2, Curve=fillet)  # -> Relationship, Point
dispatch_4 = Dispatch(List=merge_4, DispatchPattern=incurve.Relationship)  # -> ListA, ListB
crv_5 = Curve(dispatch_4.ListA)

merge_5 = Merge(Data1=crv_5, Data2=fillet_2)
