# Grasshopper definition Quadrilateral_Star_Channel.gh (Grasshopper 1.0.8)

# ---- group: ignore
气口宽度 = Slider(7, range=0..100)
气口长度 = Slider(54, range=0..100)

# ---- group: Detailed parameter adjustment
channel_width = Slider(0, range=0..10)

# ---- group: Global adjustment
horizontal_arrays_number = Slider(3, range=0..100)
vertical_arrays_number = Slider(5, range=0..100)

# ----
crv = Curve(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)
crv_2 = Curve(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)
neg = Negative(Value=channel_width)
offset = OffsetCurve(Curve=crv_2, Distance=neg, Corners=1)
series = Series(Start="46", Step="46", Count=expr("x-1", horizontal_arrays_number))
rectangle = Rectangle(Plane=PlaneXY(0, 0, 0), XSize=气口长度, YSize=气口宽度, Radius=0)  # -> Rectangle, Length
series_2 = Series(Start="46", Step="46", Count=horizontal_arrays_number)
integer_division = IntegerDivision(A=vertical_arrays_number, B="2")
mod = Modulus(A=vertical_arrays_number, B="2")
crv_3 = Curve(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)
X = UnitX(Factor=series)
X_2 = UnitX(Factor=series_2)
addition = Addition(A=mod, B=integer_division)
series_3 = Series(Start="46", Step="46", Count=expr("x-1", horizontal_arrays_number))
series_4 = Series(Start="46", Step="46", Count=expr("x-2", horizontal_arrays_number))
move = Move(Geometry=crv, Motion=X)  # -> Geometry, Transform
move_2 = Move(Geometry=offset, Motion=X_2)  # -> Geometry, Transform
move_3 = Move(Geometry=crv, Motion=X_2)  # -> Geometry, Transform
X_3 = UnitX(Factor="-23")
X_4 = UnitX(Factor=series_3)
sunion = SolidUnion(Breps=move_3.Geometry)
X_5 = UnitX(Factor=series_4)
series_5 = Series(Start="49", Step="49", Count=expr("x", addition))
sunion_2 = SolidUnion(Breps=move.Geometry)
multiplication = Multiplication(A="46", B=horizontal_arrays_number)
move_4 = Move(Geometry=crv_3, Motion=X_3)  # -> Geometry, Transform
move_5 = Move(Geometry=offset, Motion=X_4)  # -> Geometry, Transform
move_6 = Move(Geometry=crv_3, Motion=X_5)  # -> Geometry, Transform
neg_2 = Negative(Value=series_5)
edges = BrepEdges(Brep=sunion)  # -> Naked, Interior, NonManifold
edges_2 = BrepEdges(Brep=sunion_2)  # -> Naked, Interior, NonManifold
addition_2 = Addition(A=multiplication, B="20")
Y = UnitY(Factor=neg_2)
crv_4 = Curve(edges_2.Naked)
Y_2 = UnitY(Factor="-24.5")
join = JoinCurves(Curves=[crv_3, move_6.Geometry], Preserve=False)  # -> graft(Curves)
crv_5 = Curve(edges.Naked)
X_6 = UnitX(Factor=addition_2)
move_7 = Move(Geometry=graft(move_2.Geometry), Motion=Y)  # -> Geometry, Transform
move_8 = Move(Geometry=graft(crv_5), Motion=Y)  # -> flatten(Geometry), Transform
series_6 = Series(Start="46", Step="46", Count=expr("x-1", horizontal_arrays_number))
move_9 = Move(Geometry=move_4.Geometry, Motion=Y_2)  # -> Geometry, Transform
series_7 = Series(Start="49", Step="49", Count=expr("x-1", addition))
move_10 = Move(Geometry=rectangle.Rectangle, Motion=X_6)  # -> Geometry, Transform
X_7 = UnitX(Factor=series_6)
integer_division_2 = IntegerDivision(A=vertical_arrays_number, B="2")
X_8 = UnitX(Factor="23")
join_2 = JoinCurves(Curves=move_8.Geometry, Preserve=False)
move_11 = Move(Geometry=move_5.Geometry, Motion=X_8)  # -> Geometry, Transform
move_12 = Move(Geometry=crv_4, Motion=X_8)  # -> Geometry, Transform
neg_3 = Negative(Value=series_7)
move_13 = Move(Geometry=move_9.Geometry, Motion=X_7)  # -> Geometry, Transform
series_8 = Series(Start="49", Step="49", Count=expr("x", integer_division_2))
Y_3 = UnitY(Factor="-83.5")
Y_4 = UnitY(Factor=neg_3)
move_14 = Move(Geometry=join, Motion=Y_4)  # -> Geometry, Transform
neg_4 = Negative(Value="24.5")
join_3 = JoinCurves(Curves=[move_13.Geometry, move_9.Geometry], Preserve=False)  # -> graft(Curves)
move_15 = Move(Geometry=move_10.Geometry, Motion=Y_3)  # -> Geometry, Transform
Y_5 = UnitY(Factor=neg_4)
neg_5 = Negative(Value=series_8)
move_16 = Move(Geometry=move_11.Geometry, Motion=Y_5)  # -> Geometry, Transform
move_17 = Move(Geometry=move_12.Geometry, Motion=Y_5)  # -> Geometry, Transform
series_9 = Series(Start="49", Step="49", Count=expr("x-1", integer_division))
join_4 = JoinCurves(Curves=crv_5, Preserve=False)
join_5 = JoinCurves(Curves=move_17.Geometry, Preserve=False)
Y_6 = UnitY(Factor=neg_5)
neg_6 = Negative(Value=series_9)
move_18 = Move(Geometry=graft(move_17.Geometry), Motion=Y_6)  # -> flatten(Geometry), Transform
sunion_3 = SolidUnion(Breps=[join_4, join_5])
move_19 = Move(Geometry=graft(move_16.Geometry), Motion=Y_6)  # -> Geometry, Transform
Y_7 = UnitY(Factor=neg_6)
move_20 = Move(Geometry=join_3, Motion=Y_7)  # -> Geometry, Transform
join_6 = JoinCurves(Curves=[move_14.Geometry, join_3, join, move_20.Geometry], Preserve=False)  # -> flatten(Curves)
edges_3 = BrepEdges(Brep=sunion_3)  # -> Naked, Interior, NonManifold
join_7 = JoinCurves(Curves=move_18.Geometry, Preserve=False)
sunion_4 = SolidUnion(Breps=[join_2, join_7])
edges_4 = BrepEdges(Brep=sunion_4)  # -> Naked, Interior, NonManifold
crv_6 = Curve(edges_4.Naked)
merge = Merge(Data1=move_17.Geometry, Data2=move_8.Geometry, Data3=crv_5, Data4=move_18.Geometry)
join_8 = JoinCurves(Curves=crv_6, Preserve=False)  # -> flatten(Curves)
sunion_5 = SolidUnion(Breps=[move_15.Geometry, join_8])
edges_5 = BrepEdges(Brep=sunion_5)  # -> Naked, Interior, NonManifold
crv_7 = Curve(edges_5.Naked)
crv_8 = Curve(edges_3.Naked)
merge_2 = Merge(Data1=crv_7, Data2=join_6, Data3=move_7.Geometry, Data4=move_19.Geometry)
