# Grasshopper definition Triangular_Star_Channel.gh (Grasshopper 1.0.8)

# ---- group: Global adjustment
vertical_arrays_number = Slider(3, range=0..100)
horizontal_arrays_number = Slider(3, range=0..100)

# ---- group: Detailed parameter adjustment
channel_width = Slider(0, range=0..10)

# ---- group: ignore
气口宽度 = Slider(7, range=0..100)
气口长度 = Slider(54, range=0..100)

# ----
crv = Curve(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)
crv_2 = Curve(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)
neg = Negative(Value=channel_width)
rectangle = Rectangle(Plane=PlaneXY(0, 0, 0), XSize=气口长度, YSize=气口宽度, Radius=0)  # -> Rectangle, Length
series = Series(Start="32", Step="32", Count=horizontal_arrays_number)
integer_division = IntegerDivision(A=vertical_arrays_number, B="2")
mod = Modulus(A=vertical_arrays_number, B="2")
offset = OffsetCurve(Curve=crv, Distance=neg, Corners=1)
X = UnitX(Factor=series)
addition = Addition(A=mod, B=integer_division)
move = Move(Geometry=offset, Motion=X)  # -> Geometry, Transform
move_2 = Move(Geometry=crv_2, Motion=X)  # -> Geometry, Transform
sunion = SolidUnion(Breps=move_2.Geometry)
series_2 = Series(Start="57", Step="57", Count=expr("x", addition))
multiplication = Multiplication(A="32", B=horizontal_arrays_number)
neg_2 = Negative(Value=series_2)
edges = BrepEdges(Brep=sunion)  # -> Naked, Interior, NonManifold
addition_2 = Addition(A=multiplication, B="40")
Y = UnitY(Factor=neg_2)
crv_3 = Curve(edges.Naked)
X_2 = UnitX(Factor=addition_2)
move_3 = Move(Geometry=graft(move.Geometry), Motion=Y)  # -> Geometry, Transform
move_4 = Move(Geometry=graft(crv_3), Motion=Y)  # -> flatten(Geometry), Transform
move_5 = Move(Geometry=rectangle.Rectangle, Motion=X_2)  # -> Geometry, Transform
integer_division_2 = IntegerDivision(A=vertical_arrays_number, B="2")
X_3 = UnitX(Factor="17")
join = JoinCurves(Curves=move_4.Geometry, Preserve=False)
move_6 = Move(Geometry=move.Geometry, Motion=X_3)  # -> Geometry, Transform
move_7 = Move(Geometry=crv_3, Motion=X_3)  # -> Geometry, Transform
series_3 = Series(Start="57", Step="57", Count=expr("x", integer_division_2))
Y_2 = UnitY(Factor="-79")
neg_3 = Negative(Value="28.5")
move_8 = Move(Geometry=move_5.Geometry, Motion=Y_2)  # -> Geometry, Transform
Y_3 = UnitY(Factor=neg_3)
neg_4 = Negative(Value=series_3)
move_9 = Move(Geometry=move_7.Geometry, Motion=Y_3)  # -> Geometry, Transform
move_10 = Move(Geometry=move_6.Geometry, Motion=Y_3)  # -> Geometry, Transform
join_2 = JoinCurves(Curves=crv_3, Preserve=False)
join_3 = JoinCurves(Curves=move_9.Geometry, Preserve=False)
Y_4 = UnitY(Factor=neg_4)
move_11 = Move(Geometry=graft(move_9.Geometry), Motion=Y_4)  # -> flatten(Geometry), Transform
sunion_2 = SolidUnion(Breps=[join_2, join_3])
move_12 = Move(Geometry=graft(move_10.Geometry), Motion=Y_4)  # -> Geometry, Transform
edges_2 = BrepEdges(Brep=sunion_2)  # -> Naked, Interior, NonManifold
join_4 = JoinCurves(Curves=move_11.Geometry, Preserve=False)
sunion_3 = SolidUnion(Breps=[join, join_4])
edges_3 = BrepEdges(Brep=sunion_3)  # -> Naked, Interior, NonManifold
crv_4 = Curve(edges_3.Naked)
merge = Merge(Data1=move_9.Geometry, Data2=move_4.Geometry, Data3=crv_3, Data4=move_11.Geometry)
join_5 = JoinCurves(Curves=crv_4, Preserve=False)  # -> flatten(Curves)
sunion_4 = SolidUnion(Breps=[move_8.Geometry, join_5])
edges_4 = BrepEdges(Brep=sunion_4)  # -> Naked, Interior, NonManifold
crv_5 = Curve(edges_4.Naked)
crv_6 = Curve(edges_2.Naked)
merge_2 = Merge(Data1=move_12.Geometry, Data2=crv_5, Data3=move_3.Geometry)
