# Grasshopper definition Asymmetric_Side_Slit.gh (Grasshopper 1.0.8)

# ---- group: Global adjustment
number_of_units = Slider(4, range=0..100)

# ---- group: Detailed parameter adjustment
single_column_width = Slider(40, range=0..100)
side_slits_length = Slider(15, range=0..100)
channel_width = Slider(8, range=0..100)
central_slits_length = Slider(3, range=0..100)

# ---- group: ignore
气道口宽度 = Slider(9, range=0..100)
气道口长度 = Slider(56, range=0..100)

# ----
subtraction = Subtraction(A=single_column_width, B=气道口宽度)
neg = Negative(Value=central_slits_length)
pt = Point(Point(0, 0, 0))
Y = UnitY(Factor=气道口宽度)
Y_2 = UnitY(Factor=central_slits_length)
X = UnitX(Factor=气道口长度)
crv = Curve(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)
X_2 = UnitX(Factor=气道口长度)
crv_2 = Curve(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)
X_3 = UnitX(Factor=channel_width)
move = Move(Geometry=pt, Motion=Y)  # -> Geometry, Transform
move_2 = Move(Geometry=move.Geometry, Motion=X)  # -> Geometry, Transform
move_3 = Move(Geometry=pt, Motion=X_2)  # -> Geometry, Transform
Y_3 = UnitY(Factor=neg)
division = Division(A=subtraction, B="2")
neg_2 = Negative(Value=division)
Y_4 = UnitY(Factor=division)
ln = Line(StartPoint=move_3.Geometry, EndPoint=pt)
ln_2 = Line(StartPoint=move.Geometry, EndPoint=pt)
ln_3 = Line(StartPoint=move_2.Geometry, EndPoint=move.Geometry)
X_4 = UnitX(Factor=channel_width)
Y_5 = UnitY(Factor=side_slits_length)
multiplication = Multiplication(A="pi", B=channel_width)
Y_6 = UnitY(Factor=neg_2)
move_4 = Move(Geometry=move_2.Geometry, Motion=Y_4)  # -> Geometry, Transform
move_5 = Move(Geometry=move_4.Geometry, Motion=Y_3)  # -> Geometry, Transform
multiplication_2 = Multiplication(A=channel_width, B="2")
move_6 = Move(Geometry=move_4.Geometry, Motion=X_4)  # -> Geometry, Transform
pt_2 = Point(move_6.Geometry)
vec2pt = Vector2Pt(PointA=pt, PointB=move_6.Geometry, Unitize=False)  # -> Vector, Length
move_7 = Move(Geometry=crv, Motion=vec2pt.Vector)  # -> Geometry, Transform
move_8 = Move(Geometry=move_3.Geometry, Motion=Y_6)  # -> Geometry, Transform
move_9 = Move(Geometry=move_8.Geometry, Motion=Y_2)  # -> Geometry, Transform
move_10 = Move(Geometry=move_9.Geometry, Motion=X_4)  # -> Geometry, Transform
multiplication_3 = Multiplication(A=channel_width, B=number_of_units, C="2")
ln_4 = Line(StartPoint=move_5.Geometry, EndPoint=move_9.Geometry)
multiplication_4 = Multiplication(A=channel_width, B="2*pi")
ln_5 = Line(StartPoint=move_4.Geometry, EndPoint=move_2.Geometry)
move_11 = Move(Geometry=move_8.Geometry, Motion=X_4)  # -> Geometry, Transform
pt_3 = Point(move_11.Geometry)
vec2pt_2 = Vector2Pt(PointA=pt, PointB=move_11.Geometry, Unitize=False)  # -> Vector, Length
move_12 = Move(Geometry=pt_3, Motion=X_3)  # -> Geometry, Transform
move_13 = Move(Geometry=move_12.Geometry, Motion=Y_5)  # -> Geometry, Transform
vec2pt_3 = Vector2Pt(PointA=pt_2, PointB=move_13.Geometry, Unitize=False)  # -> Vector, Length
ln_6 = Line(StartPoint=move_13.Geometry, EndPoint=move_12.Geometry)  # -> graft(Line)
series = Series(Start=multiplication_2, Step=multiplication_2, Count=expr("x-1", number_of_units))
dom = ConstructDomain(DomainStart=multiplication, DomainEnd=multiplication_4)
dom_2 = ConstructDomain(DomainStart=0, DomainEnd=multiplication)
ln_7 = Line(StartPoint=move_8.Geometry, EndPoint=move_3.Geometry)
vec2pt_4 = Vector2Pt(PointA=pt, PointB=move_10.Geometry, Unitize=False)  # -> Vector, Length
move_14 = Move(Geometry=crv_2, Motion=vec2pt_4.Vector)  # -> graft(Geometry), Transform
cir = Circle(Plane=move_6.Geometry, Radius=channel_width)
move_15 = Move(Geometry=move_5.Geometry, Motion=X_4)  # -> Geometry, Transform
X_5 = UnitX(Factor=multiplication_3)
move_16 = Move(Geometry=move_7.Geometry, Motion=vec2pt_3.Vector)  # -> Geometry, Transform
cir_2 = Circle(Plane=move_11.Geometry, Radius=channel_width)
X_6 = UnitX(Factor=series)
ln_8 = Line(StartPoint=move_4.Geometry, EndPoint=move_8.Geometry)
subcrv = SubCurve(BaseCurve=cir, Domain=dom_2)
vec2pt_5 = Vector2Pt(PointA=pt, PointB=move_15.Geometry, Unitize=False)  # -> Vector, Length
move_17 = Move(Geometry=crv, Motion=vec2pt_5.Vector)  # -> Geometry, Transform
move_18 = Move(Geometry=[move_17.Geometry, move_14.Geometry], Motion=X_6)  # -> Geometry, Transform
subcrv_2 = SubCurve(BaseCurve=cir_2, Domain=dom)  # -> graft(Curve)
multiplication_5 = Multiplication(A=channel_width, B="2")
multiplication_6 = Multiplication(A=channel_width, B="2")
move_19 = Move(Geometry=ln_8, Motion=X_5)  # -> Geometry, Transform
series_2 = Series(Start=multiplication_5, Step=multiplication_5, Count=expr("x-1", number_of_units))
X_7 = UnitX(Factor=series_2)
multiplication_7 = Multiplication(A=channel_width, B="2")
move_20 = Move(Geometry=[subcrv, subcrv_2], Motion=X_7)  # -> Geometry, Transform
join = JoinCurves(Curves=[ln_7, ln], Preserve=False)
join_2 = JoinCurves(Curves=[ln_5, ln_3], Preserve=False)
series_3 = Series(Start=multiplication_6, Step=multiplication_6, Count=expr("x-2", number_of_units))
X_8 = UnitX(Factor=channel_width)
panel = Panel(series_2)
X_9 = UnitX(Factor=series_3)
move_21 = Move(Geometry=[move_16.Geometry, ln_6], Motion=X_9)  # -> Geometry, Transform
series_4 = Series(Start=multiplication_7, Step=multiplication_7, Count=expr("x-1", number_of_units))
fillet = Fillet(Curve=join, Radius="2")
fillet_2 = Fillet(Curve=join_2, Radius="2")
move_22 = Move(Geometry=ln_4, Motion=X_8)  # -> Geometry, Transform
X_10 = UnitX(Factor=series_4)
move_23 = Move(Geometry=move_22.Geometry, Motion=X_10)  # -> Geometry, Transform
merge = Merge(
    Data1=fillet,
    Data2=move_20.Geometry,
    Data3=fillet_2,
    Data4=move_23.Geometry,
    Data5=move_22.Geometry,
    Data6=subcrv,
    Data7=subcrv_2,
    Data8=move_21.Geometry,
    Data9=move_16.Geometry,
    Data10=ln_6,
    Data11=move_18.Geometry,
    Data12=move_19.Geometry,
    Data13=ln_2,
    Data14=move_14.Geometry,
    Data15=move_17.Geometry)
