# Grasshopper definition Nonuniform Channel – Vertically Graded.gh (Grasshopper 1.0.8)

# ---- group: Detailed parameter adjustment
single_column_width = Slider(40, range=0..100)
starting_channel_width = Slider(9, range=0..100)
edge_chamfer = Slider(7, range=0..100)
ending_channel_width = Slider(18, range=0..100)
central_slits_length = Slider(0, range=0..100)

# ---- group: Global adjustment
number_of_units = Slider(4, range=0..100)

# ---- group: ignore
气道口宽度 = Slider(9, range=0..100)
气道口长度 = Slider(43, range=0..100)

# ----
addition = Addition(A=central_slits_length, B="2")
subtraction = Subtraction(A=number_of_units, B="1")
subtraction_2 = Subtraction(A=single_column_width, B=气道口宽度)
subtraction_3 = Subtraction(A=ending_channel_width, B=starting_channel_width)
pt = Point(Point(0, 0, 0))
Y = UnitY(Factor=气道口宽度)
X = UnitX(Factor=气道口长度)
X_2 = UnitX(Factor=气道口长度)
crv = Curve(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)
neg = Negative(Value=addition)
division = Division(A=气道口宽度, B="2")
move = Move(Geometry=pt, Motion=Y)  # -> Geometry, Transform
move_2 = Move(Geometry=move.Geometry, Motion=X)  # -> Geometry, Transform
division_2 = Division(A=subtraction_3, B=subtraction)
move_3 = Move(Geometry=pt, Motion=X_2)  # -> Geometry, Transform
division_3 = Division(A=subtraction_2, B="2")
Y_2 = UnitY(Factor=division)
neg_2 = Negative(Value=division_3)
series = Series(Start=starting_channel_width, Step=division_2, Count=expr("x-1", number_of_units))
Y_3 = UnitY(Factor=division_3)
ln = Line(StartPoint=move_3.Geometry, EndPoint=pt)
ln_2 = Line(StartPoint=move.Geometry, EndPoint=pt)
ln_3 = Line(StartPoint=move_2.Geometry, EndPoint=move.Geometry)
move_4 = Move(Geometry=pt, Motion=Y_2)  # -> Geometry, Transform
Y_4 = UnitY(Factor=neg_2)
Y_5 = UnitY(Factor="2")

move_5 = Move(Geometry=move_2.Geometry, Motion=Y_3)  # -> Geometry, Transform
move_6 = Move(Geometry=move_3.Geometry, Motion=Y_4)  # -> Geometry, Transform

ma = MassAddition(Input=series)  # -> Result, PartialResults
xz = XZPlane(Origin=Point(0, 0, 0))
ln_4 = Line(StartPoint=move_5.Geometry, EndPoint=move_2.Geometry)
move_7 = Move(Geometry=move_2.Geometry, Motion=Y_5)  # -> Geometry, Transform
vec2pt = Vector2Pt(PointA=pt, PointB=move_7.Geometry, Unitize=False)  # -> Vector, Length
move_8 = Move(Geometry=crv, Motion=vec2pt.Vector)  # -> graft(Geometry), Transform
ln_5 = Line(StartPoint=move_5.Geometry, EndPoint=move_7.Geometry)
pl_origin = PlaneOrigin(Base=xz, Origin=move_4.Geometry)
X_3 = UnitX(Factor=ma.PartialResults)
Y_6 = UnitY(Factor=neg)
series_2 = Series(Start=starting_channel_width, Step=division_2, Count=number_of_units)
ln_6 = Line(StartPoint=move_5.Geometry, EndPoint=move_6.Geometry)
ln_7 = Line(StartPoint=move_6.Geometry, EndPoint=move_3.Geometry)
join = JoinCurves(Curves=[ln_7, ln], Preserve=False)
join_2 = JoinCurves(Curves=[ln_3, ln_4], Preserve=False)
ma_2 = MassAddition(Input=series_2)  # -> Result, PartialResults
move_9 = Move(Geometry=move_8.Geometry, Motion=X_3)  # -> Geometry, Transform
move_10 = Move(Geometry=ln_5, Motion=X_3)  # -> Geometry, Transform
move_11 = Move(Geometry=move_5.Geometry, Motion=Y_6)  # -> Geometry, Transform
X_4 = UnitX(Factor=ma_2.Result)
fillet = Fillet(Curve=join, Radius="2")
fillet_2 = Fillet(Curve=join_2, Radius="2")
Y_7 = UnitY(Factor="-2")
mirror = Mirror(Geometry=[move_9.Geometry, move_10.Geometry], Plane=pl_origin)  # -> Geometry, Transform
move_12 = Move(Geometry=move_5.Geometry, Motion=Y_7)  # -> Geometry, Transform
flip = FlipCurve(Curve=ln_5)  # -> Curve, Flag
Y_8 = UnitY(Factor="2")
move_13 = Move(Geometry=ln_6, Motion=X_4)  # -> Geometry, Transform
Y_9 = UnitY(Factor=addition)
flip_2 = FlipCurve(Curve=move_10.Geometry)  # -> Curve, Flag
move_14 = Move(Geometry=move_6.Geometry, Motion=Y_8)  # -> Geometry, Transform
ln_8 = Line(StartPoint=move_12.Geometry, EndPoint=move_14.Geometry)
move_15 = Move(Geometry=move_6.Geometry, Motion=Y_9)  # -> Geometry, Transform
merge = Merge(Data1=move_10.Geometry, Data2=move_13.Geometry)  # -> graft(Result)
merge_2 = Merge(Data1=flip.Curve, Data2=flip_2.Curve)  # -> graft(Result)
series_3 = Series(Start=starting_channel_width, Step=division_2, Count=expr("x-1", number_of_units))
series_4 = Series(Start=starting_channel_width, Step=division_2, Count=number_of_units)
division_4 = Division(A=starting_channel_width, B="2")
division_5 = Division(A=starting_channel_width, B="2")
Y_10 = UnitY(Factor=edge_chamfer)
ln_9 = Line(StartPoint=move_11.Geometry, EndPoint=move_15.Geometry)
multiplication = Multiplication(A=series_4, B="1/2")
X_5 = UnitX(Factor=division_4)
X_6 = UnitX(Factor=division_5)
move_16 = Move(Geometry=ln_9, Motion=X_6)  # -> Geometry, Transform
multiplication_2 = Multiplication(A=series_3, B="1/2")
cull_i = CullIndex(List=multiplication, Indices="0", Wrap=True)
move_17 = Move(Geometry=move_11.Geometry, Motion=X_5)  # -> Geometry, Transform
crv_2 = Curve(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)
addition_2 = Addition(A=multiplication_2, B=cull_i)
move_18 = Move(Geometry=move_12.Geometry, Motion=X_6)  # -> Geometry, Transform
vec2pt_2 = Vector2Pt(PointA=pt, PointB=move_17.Geometry, Unitize=False)  # -> Vector, Length
ma_3 = MassAddition(Input=addition_2)  # -> Result, PartialResults
X_7 = UnitX(Factor=ma_3.PartialResults)
move_19 = Move(Geometry=crv_2, Motion=vec2pt_2.Vector)  # -> Geometry, Transform
remap = RemapNumbers(Value=series_4, Source=series_4, Target=Domain(0, 1))  # -> Mapped, Clipped
move_20 = Move(Geometry=move_16.Geometry, Motion=X_7)  # -> Geometry, Transform
move_21 = Move(Geometry=move_19.Geometry, Motion=X_7)  # -> Geometry, Transform
panel = Panel(remap.Mapped)
mirror_2 = Mirror(Geometry=[move_21.Geometry, move_19.Geometry], Plane=pl_origin)  # -> Geometry, Transform
move_22 = Move(Geometry=move_18.Geometry, Motion=X_7)  # -> Geometry, Transform
merge_3 = Merge(Data1=move_18.Geometry, Data2=move_22.Geometry)
move_23 = Move(Geometry=merge_3, Motion=Y_10)  # -> graft(Geometry), Transform
blendcpt = BlendCurvePt(CurveA=merge_2, CurveB=merge, Point=move_23.Geometry, Continuity=2)
mirror_3 = Mirror(Geometry=blendcpt, Plane=pl_origin)  # -> Geometry, Transform
merge_4 = Merge(
    Data1=ln_5,
    Data2=mirror_3.Geometry,
    Data3=merge,
    Data4=merge_2,
    Data5=move_21.Geometry,
    Data6=move_19.Geometry,
    Data7=move_20.Geometry,
    Data8=blendcpt,
    Data9=move_13.Geometry,
    Data10=mirror.Geometry,
    Data11=fillet,
    Data12=fillet_2,
    Data13=move_16.Geometry,
    Data14=move_9.Geometry,
    Data15=ln_2,
    Data16=mirror_2.Geometry)
