# Grasshopper definition Pirimitive.gh (Grasshopper 1.0.8)

阵列数量 = Slider(4, range=0..100)
气道口宽度 = Slider(7, range=0..100)
气道口长度 = Slider(56, range=0..100)
单气道宽度 = Slider(8, range=0..100)
气道长度 = Slider(40, range=0..100)
短线切割长度 = Slider(12, range=0..100)
subtraction = Subtraction(A=气道长度, B=气道口宽度)
X = UnitX(Factor=单气道宽度)
pt = Point(Point(0, 0, 0))
Y = UnitY(Factor=气道口宽度)
X_2 = UnitX(Factor=气道口长度)
X_3 = UnitX(Factor=气道口长度)
crv = Curve(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)
crv_2 = Curve(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)
X_4 = UnitX(Factor=单气道宽度)
move = Move(Geometry=pt, Motion=Y)  # -> Geometry, Transform
move_2 = Move(Geometry=move.Geometry, Motion=X_2)  # -> Geometry, Transform
division = Division(A=subtraction, B="2")
move_3 = Move(Geometry=pt, Motion=X_3)  # -> Geometry, Transform
neg = Negative(Value=短线切割长度)
neg_2 = Negative(Value=division)
ln = Line(StartPoint=move_3.Geometry, EndPoint=pt)
ln_2 = Line(StartPoint=move.Geometry, EndPoint=pt)
ln_3 = Line(StartPoint=move_2.Geometry, EndPoint=move.Geometry)
Y_2 = UnitY(Factor=division)
X_5 = UnitX(Factor=单气道宽度)
Y_3 = UnitY(Factor=短线切割长度)
multiplication = Multiplication(A="pi", B=单气道宽度)
Y_4 = UnitY(Factor=neg_2)
Y_5 = UnitY(Factor=neg)
move_4 = Move(Geometry=move_2.Geometry, Motion=Y_2)  # -> Geometry, Transform
multiplication_2 = Multiplication(A=单气道宽度, B="2")
move_5 = Move(Geometry=move_4.Geometry, Motion=X_5)  # -> Geometry, Transform
pt_2 = Point(move_5.Geometry)
pt_3 = Point(move_5.Geometry)
vec2pt = Vector2Pt(PointA=pt, PointB=move_5.Geometry, Unitize=False)  # -> Vector, Length
move_6 = Move(Geometry=pt_3, Motion=X)  # -> Geometry, Transform
move_7 = Move(Geometry=crv, Motion=vec2pt.Vector)  # -> Geometry, Transform
move_8 = Move(Geometry=move_6.Geometry, Motion=Y_5)  # -> Geometry, Transform
move_9 = Move(Geometry=move_3.Geometry, Motion=Y_4)  # -> Geometry, Transform
multiplication_3 = Multiplication(A=单气道宽度, B=阵列数量, C="2")
multiplication_4 = Multiplication(A=单气道宽度, B="2*pi")
ln_4 = Line(StartPoint=move_4.Geometry, EndPoint=move_2.Geometry)
ln_5 = Line(StartPoint=move_8.Geometry, EndPoint=move_6.Geometry)  # -> graft(Line)
move_10 = Move(Geometry=move_9.Geometry, Motion=X_5)  # -> Geometry, Transform
pt_4 = Point(move_10.Geometry)
vec2pt_2 = Vector2Pt(PointA=pt, PointB=move_10.Geometry, Unitize=False)  # -> Vector, Length
move_11 = Move(Geometry=pt_4, Motion=X_4)  # -> Geometry, Transform
move_12 = Move(Geometry=crv_2, Motion=vec2pt_2.Vector)  # -> graft(Geometry), Transform
move_13 = Move(Geometry=move_11.Geometry, Motion=Y_3)  # -> Geometry, Transform
vec2pt_3 = Vector2Pt(PointA=pt_2, PointB=move_13.Geometry, Unitize=False)  # -> Vector, Length
ln_6 = Line(StartPoint=move_13.Geometry, EndPoint=move_11.Geometry)  # -> graft(Line)
series = Series(Start=multiplication_2, Step=multiplication_2, Count=expr("x-1", 阵列数量))
dom = ConstructDomain(DomainStart=multiplication, DomainEnd=multiplication_4)
dom_2 = ConstructDomain(DomainStart=0, DomainEnd=multiplication)
ln_7 = Line(StartPoint=move_9.Geometry, EndPoint=move_3.Geometry)
cir = Circle(Plane=move_5.Geometry, Radius=单气道宽度)
vec2pt_4 = Vector2Pt(PointA=pt, PointB=move_8.Geometry, Unitize=False)  # -> Vector, Length
X_6 = UnitX(Factor=multiplication_3)
move_14 = Move(Geometry=move_7.Geometry, Motion=vec2pt_3.Vector)  # -> Geometry, Transform
cir_2 = Circle(Plane=move_10.Geometry, Radius=单气道宽度)
X_7 = UnitX(Factor=series)
ln_8 = Line(StartPoint=move_4.Geometry, EndPoint=move_9.Geometry)
move_15 = Move(Geometry=crv_2, Motion=vec2pt_4.Vector)  # -> Geometry, Transform
move_16 = Move(Geometry=[move_7.Geometry, move_12.Geometry], Motion=X_7)  # -> Geometry, Transform
subcrv = SubCurve(BaseCurve=cir, Domain=dom_2)
subcrv_2 = SubCurve(BaseCurve=cir_2, Domain=dom)  # -> graft(Curve)
multiplication_5 = Multiplication(A=单气道宽度, B="2")
multiplication_6 = Multiplication(A=单气道宽度, B="2")
multiplication_7 = Multiplication(A=单气道宽度, B="2")
move_17 = Move(Geometry=ln_8, Motion=X_6)  # -> Geometry, Transform
series_2 = Series(Start=multiplication_5, Step=multiplication_5, Count=expr("x-1", 阵列数量))
X_8 = UnitX(Factor=series_2)
multiplication_8 = Multiplication(A=单气道宽度, B="2")
move_18 = Move(Geometry=[subcrv, subcrv_2], Motion=X_8)  # -> Geometry, Transform
join = JoinCurves(Curves=[ln_7, ln], Preserve=False)
join_2 = JoinCurves(Curves=[ln_4, ln_3], Preserve=False)
series_3 = Series(Start=multiplication_6, Step=multiplication_6, Count=expr("x-2", 阵列数量))
series_4 = Series(Start=multiplication_7, Step=multiplication_7, Count=expr("x-2", 阵列数量))
X_9 = UnitX(Factor=单气道宽度)
panel = Panel(series_2)
series_5 = Series(Start=multiplication_8, Step=multiplication_8, Count=expr("x-1", 阵列数量))
X_10 = UnitX(Factor=series_3)
move_19 = Move(Geometry=[move_14.Geometry, ln_6], Motion=X_10)  # -> Geometry, Transform
fillet = Fillet(Curve=join, Radius="2")
fillet_2 = Fillet(Curve=join_2, Radius="2")
X_11 = UnitX(Factor=series_4)
move_20 = Move(Geometry=[move_15.Geometry, ln_5], Motion=X_11)  # -> Geometry, Transform
move_21 = Move(Geometry=ln_8, Motion=X_9)  # -> Geometry, Transform
X_12 = UnitX(Factor=series_5)
move_22 = Move(Geometry=move_21.Geometry, Motion=X_12)  # -> Geometry, Transform
merge = Merge(
    Data1=move_22.Geometry,
    Data2=move_21.Geometry,
    Data3=fillet_2,
    Data4=fillet,
    Data5=move_18.Geometry,
    Data6=subcrv,
    Data7=move_17.Geometry,
    Data8=move_16.Geometry,
    Data9=move_19.Geometry,
    Data10=move_14.Geometry,
    Data11=ln_6,
    Data12=move_20.Geometry,
    Data13=move_15.Geometry,
    Data14=ln_5,
    Data15=subcrv,
    Data16=move_7.Geometry,
    Data17=move_12.Geometry,
    Data18=ln_2,
    Data19=subcrv_2)
